# Grasshopper definition 2D-3D_exo.gh (Grasshopper 0.9.76)

number_slider = Slider(5, range=0..10)
number_slider_2 = Slider(4, range=0..10)
number_slider_3 = Slider(0, range=0..10)
pt = ConstructPoint(XCoordinate=number_slider_3, YCoordinate="0", ZCoordinate=Slider(5, range=0..10))
pt_2 = ConstructPoint(XCoordinate=number_slider, YCoordinate="0", ZCoordinate=number_slider)
pt_3 = ConstructPoint(XCoordinate=number_slider_3, YCoordinate="0", ZCoordinate=number_slider_2)
pt_4 = ConstructPoint(XCoordinate=Slider(2, range=0..10), YCoordinate="0", ZCoordinate=number_slider_2)
pt_5 = ConstructPoint(XCoordinate=number_slider_3, YCoordinate="0", ZCoordinate=number_slider_3)
path = FilePath("C:\Users\doorn\OneDrive\Docs\Soft-Robotics\NUS SR\Models\2D-3D_EXO\Test Images\output.csv")
file = ReadFile(F=path, PerLineParse=True)  # -> C
#   port F: Uri of file to read
# ---------- file: VB line parser ----------
    action = GH_LineParserAction.Include
    Return line

    'Parse the line and return some data that represents the line.
    'If the line cannot be parsed, you can return Nothing and
    'assign a different action.
    'The default implementation is to just return the line itself.
    'If you return types that implement IGH_Goo, this component
    'will work substantially faster.
# ---------- end file ----------
panel = Panel("14")
panel_2 = Panel("15")
ln = Line(StartPoint=pt, EndPoint=pt_2)
ln_2 = Line(StartPoint=pt_3, EndPoint=pt)
ln_3 = Line(StartPoint=pt_4, EndPoint=pt_2)
ln_4 = Line(StartPoint=pt_5, EndPoint=pt_4)
ln_5 = Line(StartPoint=pt_5, EndPoint=pt_3)
panel_3 = Panel(file)
boundary = BoundarySurfaces(Edges=[ln_4, ln_5, ln_3, ln_2, ln])
number_slider_4 = Slider(13, range=0..100)
number_slider_5 = Slider(43, range=0..100)
number_slider_6 = Slider(40, range=0..100)
partition = PartitionList(List=panel_3, Size="4")
panel_4 = Panel(partition)
range = Range(Domain=number_slider_4, Steps=number_slider_4)
number_slider_7 = Slider(55, range=0..100)
srf = Surface(boundary)
crv = Curve(boundary)
get_joint_points = GetJointPoints(T_3=panel_4, T_4=panel_4, T=panel_4, T_2=panel_4, F=range)  # -> R, R_2
pdecon = Deconstruct(Point=get_joint_points.R)  # -> XComponent, YComponent, ZComponent
pdecon_2 = Deconstruct(Point=get_joint_points.R_2)  # -> XComponent, YComponent, ZComponent
pt_6 = ConstructPoint(XCoordinate=pdecon.XComponent, YCoordinate=pdecon.YComponent, ZCoordinate=number_slider_7)
pt_7 = ConstructPoint(XCoordinate=pdecon_2.XComponent, YCoordinate=pdecon_2.YComponent, ZCoordinate=number_slider_7)
pt_8 = Point(get_joint_points.R)
pt_9 = Point(get_joint_points.R_2)
srf4pt = _4PointSurface(CornerA=pt_6, CornerB=pt_8, CornerC=pt_9, CornerD=pt_7)
map_srf = MapToSurface(Curve=crv, Source=srf, Target=srf4pt)
divide = DivideCurve(Curve=map_srf, Count=number_slider_6, Kinks="True")  # -> Points, Tangents, Parameters
get_joint_points_2 = GetJointPoints(T_3=panel_4, T_4=panel_4, T=panel_4, T_2=panel_4, F="0")  # -> R, R_2
get_joint_points_3 = GetJointPoints(T_3=panel_4, T_4=panel_4, T=panel_4, T_2=panel_4, F="1")  # -> R, R_2
get_joint_points_4 = GetJointPoints(T_3=panel_4, T_4=panel_4, T=panel_4, T_2=panel_4, F="2")  # -> R, R_2
get_joint_points_5 = GetJointPoints(T_3=panel_4, T_4=panel_4, T=panel_4, T_2=panel_4, F="3")  # -> R, R_2
get_joint_points_6 = GetJointPoints(T_3=panel_4, T_4=panel_4, T=panel_4, T_2=panel_4, F="3")  # -> R, R_2
get_joint_points_7 = GetJointPoints(T_3=panel_4, T_4=panel_4, T=panel_4, T_2=panel_4, F="4")  # -> R, R_2
get_joint_points_8 = GetJointPoints(T_3=panel_4, T_4=panel_4, T=panel_4, T_2=panel_4, F="5")  # -> R, R_2
get_joint_points_9 = GetJointPoints(T_3=panel_4, T_4=panel_4, T=panel_4, T_2=panel_4, F="6")  # -> R, R_2
get_joint_points_10 = GetJointPoints(T_3=panel_4, T_4=panel_4, T=panel_4, T_2=panel_4, F="6")  # -> R, R_2
get_joint_points_11 = GetJointPoints(T_3=panel_4, T_4=panel_4, T=panel_4, T_2=panel_4, F="7")  # -> R, R_2
get_joint_points_12 = GetJointPoints(T_3=panel_4, T_4=panel_4, T=panel_4, T_2=panel_4, F="8")  # -> R, R_2
get_joint_points_13 = GetJointPoints(T_3=panel_4, T_4=panel_4, T=panel_4, T_2=panel_4, F="9")  # -> R, R_2
get_joint_points_14 = GetJointPoints(T_3=panel_4, T_4=panel_4, T=panel_4, T_2=panel_4, F="9")  # -> R, R_2
get_joint_points_15 = GetJointPoints(T_3=panel_4, T_4=panel_4, T=panel_4, T_2=panel_4, F="10")  # -> R, R_2
get_joint_points_16 = GetJointPoints(T_3=panel_4, T_4=panel_4, T=panel_4, T_2=panel_4, F="11")  # -> R, R_2
get_joint_points_17 = GetJointPoints(T_3=panel_4, T_4=panel_4, T=panel_4, T_2=panel_4, F="12")  # -> R, R_2
get_joint_points_18 = GetJointPoints(T_3=panel_4, T_4=panel_4, T=panel_4, T_2=panel_4, F="12")  # -> R, R_2
get_joint_points_19 = GetJointPoints(T_3=panel_4, T_4=panel_4, T=panel_4, T_2=panel_4, F="13")  # -> R, R_2
pdecon_3 = Deconstruct(Point=get_joint_points_2.R)  # -> XComponent, YComponent, ZComponent
pdecon_4 = Deconstruct(Point=get_joint_points_2.R_2)  # -> XComponent, YComponent, ZComponent
pdecon_5 = Deconstruct(Point=get_joint_points_3.R)  # -> XComponent, YComponent, ZComponent
pdecon_6 = Deconstruct(Point=get_joint_points_3.R_2)  # -> XComponent, YComponent, ZComponent
pdecon_7 = Deconstruct(Point=get_joint_points_4.R)  # -> XComponent, YComponent, ZComponent
pdecon_8 = Deconstruct(Point=get_joint_points_4.R_2)  # -> XComponent, YComponent, ZComponent
pdecon_9 = Deconstruct(Point=get_joint_points_5.R)  # -> XComponent, YComponent, ZComponent
pdecon_10 = Deconstruct(Point=get_joint_points_5.R_2)  # -> XComponent, YComponent, ZComponent
pdecon_11 = Deconstruct(Point=get_joint_points_7.R)  # -> XComponent, YComponent, ZComponent
pdecon_12 = Deconstruct(Point=get_joint_points_7.R_2)  # -> XComponent, YComponent, ZComponent
pdecon_13 = Deconstruct(Point=get_joint_points_8.R)  # -> XComponent, YComponent, ZComponent
pdecon_14 = Deconstruct(Point=get_joint_points_8.R_2)  # -> XComponent, YComponent, ZComponent
pdecon_15 = Deconstruct(Point=get_joint_points_9.R)  # -> XComponent, YComponent, ZComponent
pdecon_16 = Deconstruct(Point=get_joint_points_9.R_2)  # -> XComponent, YComponent, ZComponent
pdecon_17 = Deconstruct(Point=get_joint_points_11.R)  # -> XComponent, YComponent, ZComponent
pdecon_18 = Deconstruct(Point=get_joint_points_11.R_2)  # -> XComponent, YComponent, ZComponent
pdecon_19 = Deconstruct(Point=get_joint_points_12.R)  # -> XComponent, YComponent, ZComponent
pdecon_20 = Deconstruct(Point=get_joint_points_12.R_2)  # -> XComponent, YComponent, ZComponent
pdecon_21 = Deconstruct(Point=get_joint_points_14.R)  # -> XComponent, YComponent, ZComponent
pdecon_22 = Deconstruct(Point=get_joint_points_14.R_2)  # -> XComponent, YComponent, ZComponent
pdecon_23 = Deconstruct(Point=get_joint_points_15.R)  # -> XComponent, YComponent, ZComponent
pdecon_24 = Deconstruct(Point=get_joint_points_15.R_2)  # -> XComponent, YComponent, ZComponent
pdecon_25 = Deconstruct(Point=get_joint_points_16.R)  # -> XComponent, YComponent, ZComponent
pdecon_26 = Deconstruct(Point=get_joint_points_16.R_2)  # -> XComponent, YComponent, ZComponent
pdecon_27 = Deconstruct(Point=get_joint_points_17.R)  # -> XComponent, YComponent, ZComponent
pdecon_28 = Deconstruct(Point=get_joint_points_17.R_2)  # -> XComponent, YComponent, ZComponent
pdecon_29 = Deconstruct(Point=get_joint_points_19.R)  # -> XComponent, YComponent, ZComponent
pdecon_30 = Deconstruct(Point=get_joint_points_19.R_2)  # -> XComponent, YComponent, ZComponent
pt_10 = ConstructPoint(XCoordinate=pdecon_3.XComponent, YCoordinate=pdecon_3.YComponent, ZCoordinate=number_slider_7)
pt_11 = ConstructPoint(XCoordinate=pdecon_4.XComponent, YCoordinate=pdecon_4.YComponent, ZCoordinate=number_slider_7)
pt_12 = ConstructPoint(XCoordinate=pdecon_5.XComponent, YCoordinate=pdecon_5.YComponent, ZCoordinate=number_slider_7)
pt_13 = ConstructPoint(XCoordinate=pdecon_6.XComponent, YCoordinate=pdecon_6.YComponent, ZCoordinate=number_slider_7)
pt_14 = ConstructPoint(XCoordinate=pdecon_7.XComponent, YCoordinate=pdecon_7.YComponent, ZCoordinate=number_slider_7)
pt_15 = ConstructPoint(XCoordinate=pdecon_8.XComponent, YCoordinate=pdecon_8.YComponent, ZCoordinate=number_slider_7)
pt_16 = ConstructPoint(XCoordinate=pdecon_9.XComponent, YCoordinate=pdecon_9.YComponent, ZCoordinate=number_slider_7)
pt_17 = ConstructPoint(XCoordinate=pdecon_10.XComponent, YCoordinate=pdecon_10.YComponent, ZCoordinate=number_slider_7)
pt_18 = ConstructPoint(XCoordinate=pdecon_11.XComponent, YCoordinate=pdecon_11.YComponent, ZCoordinate=number_slider_7)
pt_19 = ConstructPoint(XCoordinate=pdecon_12.XComponent, YCoordinate=pdecon_12.YComponent, ZCoordinate=number_slider_7)
pt_20 = ConstructPoint(XCoordinate=pdecon_13.XComponent, YCoordinate=pdecon_13.YComponent, ZCoordinate=number_slider_7)
pt_21 = ConstructPoint(XCoordinate=pdecon_14.XComponent, YCoordinate=pdecon_14.YComponent, ZCoordinate=number_slider_7)
pt_22 = ConstructPoint(XCoordinate=pdecon_15.XComponent, YCoordinate=pdecon_15.YComponent, ZCoordinate=number_slider_7)
pt_23 = ConstructPoint(XCoordinate=pdecon_16.XComponent, YCoordinate=pdecon_16.YComponent, ZCoordinate=number_slider_7)
pt_24 = ConstructPoint(XCoordinate=pdecon_17.XComponent, YCoordinate=pdecon_17.YComponent, ZCoordinate=number_slider_7)
pt_25 = ConstructPoint(XCoordinate=pdecon_18.XComponent, YCoordinate=pdecon_18.YComponent, ZCoordinate=number_slider_7)
pt_26 = ConstructPoint(XCoordinate=pdecon_19.XComponent, YCoordinate=pdecon_19.YComponent, ZCoordinate=number_slider_7)
pt_27 = ConstructPoint(XCoordinate=pdecon_20.XComponent, YCoordinate=pdecon_20.YComponent, ZCoordinate=number_slider_7)
pt_28 = ConstructPoint(XCoordinate=pdecon_21.XComponent, YCoordinate=pdecon_21.YComponent, ZCoordinate=number_slider_7)
pt_29 = ConstructPoint(XCoordinate=pdecon_22.XComponent, YCoordinate=pdecon_22.YComponent, ZCoordinate=number_slider_7)
pt_30 = ConstructPoint(XCoordinate=pdecon_23.XComponent, YCoordinate=pdecon_23.YComponent, ZCoordinate=number_slider_7)
pt_31 = ConstructPoint(XCoordinate=pdecon_24.XComponent, YCoordinate=pdecon_24.YComponent, ZCoordinate=number_slider_7)
pt_32 = Point(get_joint_points_3.R)
pt_33 = Point(get_joint_points_3.R_2)
pt_34 = Point(get_joint_points_2.R)
pt_35 = Point(get_joint_points_2.R_2)
pt_36 = Point(get_joint_points_4.R)
pt_37 = Point(get_joint_points_4.R_2)
pt_38 = Point(get_joint_points_5.R_2)
pt_39 = Point(get_joint_points_7.R)
pt_40 = Point(get_joint_points_5.R)
pt_41 = Point(get_joint_points_7.R_2)
pt_42 = Point(get_joint_points_8.R)
pt_43 = Point(get_joint_points_8.R_2)
pt_44 = Point(get_joint_points_9.R_2)
pt_45 = Point(get_joint_points_11.R)
pt_46 = Point(get_joint_points_9.R)
pt_47 = Point(get_joint_points_11.R_2)
pt_48 = ConstructPoint(XCoordinate=pdecon_25.XComponent, YCoordinate=pdecon_25.YComponent, ZCoordinate=number_slider_7)
pt_49 = ConstructPoint(XCoordinate=pdecon_26.XComponent, YCoordinate=pdecon_26.YComponent, ZCoordinate=number_slider_7)
pt_50 = ConstructPoint(XCoordinate=pdecon_27.XComponent, YCoordinate=pdecon_27.YComponent, ZCoordinate=number_slider_7)
pt_51 = ConstructPoint(XCoordinate=pdecon_28.XComponent, YCoordinate=pdecon_28.YComponent, ZCoordinate=number_slider_7)
pt_52 = ConstructPoint(XCoordinate=pdecon_29.XComponent, YCoordinate=pdecon_29.YComponent, ZCoordinate=number_slider_7)
pt_53 = ConstructPoint(XCoordinate=pdecon_30.XComponent, YCoordinate=pdecon_30.YComponent, ZCoordinate=number_slider_7)
pt_54 = Point(get_joint_points_12.R)
pt_55 = Point(get_joint_points_12.R_2)
pt_56 = Point(get_joint_points_14.R_2)
pt_57 = Point(get_joint_points_15.R)
pt_58 = Point(get_joint_points_14.R)
pt_59 = Point(get_joint_points_15.R_2)
pt_60 = Point(get_joint_points_16.R)
pt_61 = Point(get_joint_points_16.R_2)
pt_62 = Point(get_joint_points_17.R)
pt_63 = Point(get_joint_points_17.R_2)
pt_64 = Point(get_joint_points_19.R)
pt_65 = Point(get_joint_points_19.R_2)
srf4pt_2 = _4PointSurface(CornerA=pt_18, CornerB=pt_39, CornerC=pt_41, CornerD=pt_19)
srf4pt_3 = _4PointSurface(CornerA=pt_16, CornerB=pt_40, CornerC=pt_38, CornerD=pt_17)
srf4pt_4 = _4PointSurface(CornerA=pt_10, CornerB=pt_34, CornerC=pt_35, CornerD=pt_11)
srf4pt_5 = _4PointSurface(CornerA=pt_20, CornerB=pt_42, CornerC=pt_43, CornerD=pt_21)
srf4pt_6 = _4PointSurface(CornerA=pt_12, CornerB=pt_32, CornerC=pt_33, CornerD=pt_13)
srf4pt_7 = _4PointSurface(CornerA=pt_14, CornerB=pt_36, CornerC=pt_37, CornerD=pt_15)
srf4pt_8 = _4PointSurface(CornerA=pt_24, CornerB=pt_45, CornerC=pt_47, CornerD=pt_25)
srf4pt_9 = _4PointSurface(CornerA=pt_22, CornerB=pt_46, CornerC=pt_44, CornerD=pt_23)
srf4pt_10 = _4PointSurface(CornerA=pt_48, CornerB=pt_60, CornerC=pt_61, CornerD=pt_49)
srf4pt_11 = _4PointSurface(CornerA=pt_28, CornerB=pt_58, CornerC=pt_56, CornerD=pt_29)
srf4pt_12 = _4PointSurface(CornerA=pt_26, CornerB=pt_54, CornerC=pt_55, CornerD=pt_27)
srf4pt_13 = _4PointSurface(CornerA=pt_30, CornerB=pt_57, CornerC=pt_59, CornerD=pt_31)
srf4pt_14 = _4PointSurface(CornerA=pt_50, CornerB=pt_62, CornerC=pt_63, CornerD=pt_51)
srf4pt_15 = _4PointSurface(CornerA=pt_52, CornerB=pt_64, CornerC=pt_65, CornerD=pt_53)
map_srf_2 = MapToSurface(Curve=crv, Source=srf, Target=srf4pt_2)
map_srf_3 = MapToSurface(Curve=crv, Source=srf, Target=srf4pt_4)
map_srf_4 = MapToSurface(Curve=crv, Source=srf, Target=srf4pt_6)
map_srf_5 = MapToSurface(Curve=crv, Source=srf, Target=srf4pt_7)
map_srf_6 = MapToSurface(Curve=crv, Source=srf, Target=srf4pt_3)
map_srf_7 = MapToSurface(Curve=crv, Source=srf, Target=srf4pt_5)
map_srf_8 = MapToSurface(Curve=crv, Source=srf, Target=srf4pt_8)
map_srf_9 = MapToSurface(Curve=crv, Source=srf, Target=srf4pt_9)
map_srf_10 = MapToSurface(Curve=crv, Source=srf, Target=srf4pt_11)
map_srf_11 = MapToSurface(Curve=crv, Source=srf, Target=srf4pt_13)
map_srf_12 = MapToSurface(Curve=crv, Source=srf, Target=srf4pt_10)
map_srf_13 = MapToSurface(Curve=crv, Source=srf, Target=srf4pt_12)
map_srf_14 = MapToSurface(Curve=crv, Source=srf, Target=srf4pt_14)
map_srf_15 = MapToSurface(Curve=crv, Source=srf, Target=srf4pt_15)
divide_2 = DivideCurve(Curve=map_srf_3, Count=number_slider_6, Kinks="True")  # -> Points, Tangents, Parameters
divide_3 = DivideCurve(Curve=map_srf_4, Count=number_slider_6, Kinks="True")  # -> Points, Tangents, Parameters
divide_4 = DivideCurve(Curve=map_srf_5, Count=number_slider_6, Kinks="True")  # -> Points, Tangents, Parameters
divide_5 = DivideCurve(Curve=map_srf_6, Count=number_slider_6, Kinks="True")  # -> Points, Tangents, Parameters
pt_66 = ConstructPoint(XCoordinate="0", YCoordinate="0", ZCoordinate="0")
divide_6 = DivideCurve(Curve=map_srf_7, Count=number_slider_6, Kinks="True")  # -> Points, Tangents, Parameters
divide_7 = DivideCurve(Curve=map_srf_2, Count=number_slider_6, Kinks="True")  # -> Points, Tangents, Parameters
divide_8 = DivideCurve(Curve=map_srf_9, Count=number_slider_6, Kinks="True")  # -> Points, Tangents, Parameters
divide_9 = DivideCurve(Curve=map_srf_8, Count=number_slider_6, Kinks="True")  # -> Points, Tangents, Parameters
bzspan = BezierSpan(StartPoint=divide_2.Points, StartTangent=pt_66, EndPoint=divide_3.Points, EndTangent=pt_66)  # -> Curve, Length, Domain
range_2 = Range(Domain=number_slider_5, Steps=number_slider_5)
range_3 = Range(Domain=number_slider_5, Steps=number_slider_5)
item = ListItem(List=divide_4.Points, Index=range_2, Wrap=True)
item_2 = ListItem(List=divide_5.Points, Index=range_2, Wrap=True)
item_3 = ListItem(List=divide_7.Points, Index=range_2, Wrap=True)
item_4 = ListItem(List=divide_6.Points, Index=range_3, Wrap=True)
item_5 = ListItem(List=divide_8.Points, Index=range_3, Wrap=True)
item_6 = ListItem(List=divide_9.Points, Index=range_3, Wrap=True)
trim = TrimTree(Tree=item, Depth="3")
trim_2 = TrimTree(Tree=item_2, Depth="3")
trim_3 = TrimTree(Tree=item_3, Depth="3")
trim_4 = TrimTree(Tree=item_4, Depth="3")
trim_5 = TrimTree(Tree=item_5, Depth="3")
trim_6 = TrimTree(Tree=item_6, Depth="3")
partition_2 = PartitionList(List=trim, Size="1")
partition_3 = PartitionList(List=trim_2, Size="1")
partition_4 = PartitionList(List=trim_3, Size="1")
partition_5 = PartitionList(List=trim_4, Size="1")
partition_6 = PartitionList(List=trim_5, Size="1")
partition_7 = PartitionList(List=trim_6, Size="1")
path_mapper = PathMapper(partition_5, source="{A;B}", target="{A;B*3}")
path_mapper_2 = PathMapper(partition_6, source="{A;B}", target="{A;B*3}")
path_mapper_3 = PathMapper(partition_7, source="{A;B}", target="{A;B*3}")
merge = Merge(Data1=partition_2, Data2=partition_3, Data3=partition_4)
merge_2 = Merge(Data1=path_mapper, Data2=path_mapper_2, Data3=path_mapper_3)
panel_5 = Panel(merge)
intcrv = Interpolate(Vertices=merge_2, Degree=3, Periodic=False, KnotStyle=1)  # -> Curve, Length, Domain
intcrv_2 = Interpolate(Vertices=merge, Degree=3, Periodic=False, KnotStyle=1)  # -> Curve, Length, Domain
flatten = FlattenTree(Tree=intcrv.Curve, Path="{0}")
panel_6 = Panel(intcrv.Curve)
panel_7 = Panel(intcrv_2.Curve)
loft = Loft(Curves=flatten, Options={Adjust=False, Closed=True, LoftEnds=0, LoftSimp=0, LoftType=0, Rebuild=10, Refit=0.01})
flatten_2 = FlattenTree(Tree=intcrv_2.Curve, Path="{0}")
loft_2 = Loft(Curves=flatten_2, Options={Adjust=False, Closed=True, LoftEnds=0, LoftSimp=0, LoftType=0, Rebuild=10, Refit=0.01})
srf4pt_16 = _4PointSurface(
    CornerA=get_joint_points_2.R,
    CornerB=get_joint_points_2.R_2,
    CornerC=get_joint_points_3.R_2,
    CornerD=get_joint_points_3.R)
srf4pt_17 = _4PointSurface(
    CornerA=get_joint_points_4.R,
    CornerB=get_joint_points_4.R_2,
    CornerC=get_joint_points_5.R_2,
    CornerD=get_joint_points_5.R)
srf4pt_18 = _4PointSurface(
    CornerA=get_joint_points_6.R,
    CornerB=get_joint_points_6.R_2,
    CornerC=get_joint_points_7.R_2,
    CornerD=get_joint_points_7.R)
srf4pt_19 = _4PointSurface(
    CornerA=get_joint_points_8.R,
    CornerB=get_joint_points_8.R_2,
    CornerC=get_joint_points_9.R_2,
    CornerD=get_joint_points_9.R)
srf4pt_20 = _4PointSurface(
    CornerA=get_joint_points_10.R,
    CornerB=get_joint_points_10.R_2,
    CornerC=get_joint_points_11.R_2,
    CornerD=get_joint_points_11.R)
srf4pt_21 = _4PointSurface(
    CornerA=get_joint_points_12.R,
    CornerB=get_joint_points_12.R_2,
    CornerC=get_joint_points_13.R_2,
    CornerD=get_joint_points_13.R)
map_srf_16 = MapToSurface(Curve=boundary, Source=boundary, Target=srf4pt_21)
srf4pt_22 = _4PointSurface(
    CornerA=get_joint_points_14.R,
    CornerB=get_joint_points_14.R_2,
    CornerC=get_joint_points_15.R_2,
    CornerD=get_joint_points_15.R)
srf4pt_23 = _4PointSurface(
    CornerA=get_joint_points_16.R,
    CornerB=get_joint_points_16.R_2,
    CornerC=get_joint_points_17.R_2,
    CornerD=get_joint_points_17.R)
srf4pt_24 = _4PointSurface(
    CornerA=get_joint_points_18.R,
    CornerB=get_joint_points_18.R_2,
    CornerC=get_joint_points_19.R_2,
    CornerD=get_joint_points_19.R)
map_srf_17 = MapToSurface(Curve=boundary, Source=boundary, Target=srf4pt_20)
map_srf_18 = MapToSurface(Curve=boundary, Source=boundary, Target=srf4pt_21)
number_slider_8 = Slider(5, range=0..10)
cluster = Cluster(I=srf4pt_19, sa=srf4pt_19, S=srf4pt_19, D=number_slider_7)  # -> B_2, B_3, B
cluster_2 = Cluster(I=srf4pt_18, sa=srf4pt_18, S=srf4pt_18, D=number_slider_7)  # -> B_2, B_3, B
cluster_3 = Cluster(I=srf4pt_20, sa=srf4pt_20, S=srf4pt_20, D=number_slider_7)  # -> B_2, B_3, B
cluster_4 = Cluster(I=srf4pt_17, sa=srf4pt_17, S=srf4pt_17, D=number_slider_7)  # -> B_2, B_3, B
cluster_5 = Cluster(I=srf4pt_21, sa=srf4pt_21, S=srf4pt_21, D=number_slider_7)  # -> B_2, B_3, B
cluster_6 = Cluster(I=srf4pt_22, sa=srf4pt_22, S=srf4pt_22, D=number_slider_7)  # -> B_2, B_3, B
cluster_7 = Cluster(I=srf4pt_23, sa=srf4pt_23, S=srf4pt_23, D=number_slider_7)  # -> B_2, B_3, B
cluster_8 = Cluster(I=srf4pt_24, sa=srf4pt_24, S=srf4pt_24, D=number_slider_7)  # -> B_2, B_3, B
morph = BoxMorph(Geometry=cluster.B_2, Reference=cluster.B_3, Target=cluster.B)
morph_2 = BoxMorph(Geometry=cluster_2.B_2, Reference=cluster_2.B_3, Target=cluster_2.B)
morph_3 = BoxMorph(Geometry=cluster_3.B_2, Reference=cluster_3.B_3, Target=cluster_3.B)
morph_4 = BoxMorph(Geometry=cluster_5.B_2, Reference=cluster_5.B_3, Target=cluster_5.B)
morph_5 = BoxMorph(Geometry=cluster_6.B_2, Reference=cluster_6.B_3, Target=cluster_6.B)
morph_6 = BoxMorph(Geometry=cluster_4.B_2, Reference=cluster_4.B_3, Target=cluster_4.B)
morph_7 = BoxMorph(Geometry=cluster_7.B_2, Reference=cluster_7.B_3, Target=cluster_7.B)
morph_8 = BoxMorph(Geometry=cluster_8.B_2, Reference=cluster_8.B_3, Target=cluster_8.B)
number_slider_9 = Slider(3, range=0..10)
number_slider_10 = Slider(2, range=0..10)
number_slider_11 = Slider(0, range=0..10)
panel_8 = Panel("0")
pt_67 = ConstructPoint(XCoordinate=number_slider_11, YCoordinate=number_slider_8, ZCoordinate=Slider(5, range=0..10))
pt_68 = ConstructPoint(XCoordinate=number_slider_9, YCoordinate=number_slider_8, ZCoordinate=number_slider_9)
pt_69 = ConstructPoint(XCoordinate=number_slider_11, YCoordinate=number_slider_8, ZCoordinate=number_slider_10)
pt_70 = ConstructPoint(XCoordinate=Slider(2, range=0..10), YCoordinate=number_slider_8, ZCoordinate=number_slider_10)
pt_71 = ConstructPoint(XCoordinate=number_slider_11, YCoordinate=number_slider_8, ZCoordinate=number_slider_11)
offset = Offset(Surface=srf4pt_16, Distance=number_slider_7, Retrim=True)
ln_6 = Line(StartPoint=pt_67, EndPoint=pt_68)
ln_7 = Line(StartPoint=pt_69, EndPoint=pt_67)
ln_8 = Line(StartPoint=pt_70, EndPoint=pt_68)
ln_9 = Line(StartPoint=pt_71, EndPoint=pt_70)
ln_10 = Line(StartPoint=pt_71, EndPoint=pt_69)
pt_72 = ConstructPoint(XCoordinate="0", YCoordinate="0", ZCoordinate="-1")
number_slider_12 = Slider(40, range=0..100)
xz = XZPlane(Origin=pt_72)
divide_10 = DivideDomain²(Domain=srf4pt_16, UCount="1", VCount="1")
divide_11 = DivideDomain²(Domain=offset, UCount="1", VCount="1")
boundary_2 = BoundarySurfaces(Edges=[ln_9, ln_10, ln_8, ln_7, ln_6])
cyl = Cylinder(Base=xz, Radius="1", Length="2")
boundary_3 = BoundarySurfaces(Edges=boundary)
blendbox = BlendBox(SurfaceA=srf4pt_16, DomainA=divide_10, SurfaceB=offset, DomainB=divide_11)
boundary_4 = BoundarySurfaces(Edges=boundary_2)
number_slider_13 = Slider(0, range=0..100)
cap = CapHoles(Brep=cyl)
number_slider_14 = Slider(1, range=0..1)
divide_12 = DivideCurve(Curve=boundary, Count=number_slider_12, Kinks=number_slider_14)  # -> Points, Tangents, Parameters
bbox = BoundingBox(Content=cap, Plane=PlaneXY(0, 0, 0))  # -> Box, Box_2
morph_9 = BoxMorph(Geometry=cap, Reference=bbox.Box, Target=blendbox)
divide_13 = DivideCurve(Curve=boundary_2, Count=number_slider_12, Kinks=number_slider_14)  # -> Points, Tangents, Parameters
pt_73 = ConstructPoint(XCoordinate=number_slider_13, YCoordinate=number_slider_13, ZCoordinate=number_slider_13)
bzspan_2 = BezierSpan(StartPoint=divide_12.Points, StartTangent=pt_73, EndPoint=divide_13.Points, EndTangent=pt_73)  # -> Curve, Length, Domain
loft_3 = Loft(Curves=bzspan_2.Curve, Options={Adjust=False, Closed=True, LoftEnds=0, LoftSimp=0, LoftType=0, Rebuild=10, Refit=0.01})
capex = CapHolesEx(Brep=loft_3)  # -> Brep, Caps, Solid
preview = CustomPreview(
    Geometry=capex.Brep,
    Shader={ambient=RGB(0, 0, 0), diffuse=RGB(255, 105, 180), emission=RGB(76, 32, 54), shine=0.5, specular=RGB(255, 255, 255), transparency=0})

# ==== cluster GetJointPoints
F = ClusterInput()
concat = Concatenate(FragmentA="{", FragmentB="0", FragmentC=";", FragmentD="0", FragmentE=";", FragmentF=F, FragmentG="}")
path = DataPath(concat)
T = ClusterInput()
T_2 = ClusterInput()
T_3 = ClusterInput()
T_4 = ClusterInput()
item = TreeItem(Tree=T, Path=path, Index="2", Wrap=True)
item_2 = TreeItem(Tree=T_2, Path=path, Index="3", Wrap=True)
item_3 = TreeItem(Tree=T_3, Path=path, Index="0", Wrap=True)
item_4 = TreeItem(Tree=T_4, Path=path, Index="1", Wrap=True)
_2d_path_to_point = _2DPathToPoint(B=item_3, D=item_4)
_2d_path_to_point_2 = _2DPathToPoint(B=item, D=item_2)
R = ClusterOutput(_2d_path_to_point)
R_2 = ClusterOutput(_2d_path_to_point_2)

# ==== cluster Cluster
S = ClusterInput()
D = ClusterInput()
offset = Offset(Surface=S, Distance=D, Retrim=True)
pt = ConstructPoint(XCoordinate="0", YCoordinate="0", ZCoordinate="-1")
I = ClusterInput()
xz = XZPlane(Origin=pt)
divide = DivideDomain²(Domain=I, UCount="1", VCount="1")
divide_2 = DivideDomain²(Domain=offset, UCount="1", VCount="1")
sa = ClusterInput()
cyl = Cylinder(Base=xz, Radius="1", Length="2")
blendbox = BlendBox(SurfaceA=sa, DomainA=divide, SurfaceB=offset, DomainB=divide_2)
cap = CapHoles(Brep=cyl)
B = ClusterOutput(blendbox)
bbox = BoundingBox(Content=cap, Plane=PlaneXY(0, 0, 0))  # -> Box, Box_2
B_2 = ClusterOutput(cap)
B_3 = ClusterOutput(bbox.Box)

# ==== cluster _2DPathToPoint
B = ClusterInput()
D = ClusterInput()
concat = Concatenate(FragmentA="{", FragmentB=B, FragmentC=",", FragmentD=D, FragmentE=",", FragmentF="0", FragmentG="}")
pt = Point(concat)
pt_2 = ClusterOutput(pt)
