# Grasshopper definition 2D-3D_exo_v0.2.gh (Grasshopper 0.9.76)

# ---- group: Read File
path = FilePath("C:\Users\doorn\OneDrive\Docs\Soft-Robotics\NUS SR\Models\2D-3D_EXO\Test Images\output.csv")
file = ReadFile(F=path, PerLineParse=True)  # -> C
#   port F: Uri of file to read
# ---------- file: VB line parser ----------
    action = GH_LineParserAction.Include
    Return line

    'Parse the line and return some data that represents the line.
    'If the line cannot be parsed, you can return Nothing and
    'assign a different action.
    'The default implementation is to just return the line itself.
    'If you return types that implement IGH_Goo, this component
    'will work substantially faster.
# ---------- end file ----------
panel = Panel(file)

# ---- group: Get Joint Coordinates
partition = PartitionList(List=panel, Size="4")
joint_count = JointCount(L=partition)
range = Range(Domain=joint_count, Steps=joint_count)
get_joint_points = GetJointPoints(T=partition, F=range)  # -> R, R_2

# ----
number_slider = Slider(0, range=0..10)
number_slider_2 = Slider(4, range=0..10)
number_slider_3 = Slider(5, range=0..10)

# ---- group: Set Joint Heights
number_slider_4 = Slider(50, range=0..100)
number_slider_5 = Slider(48, range=0..100)
number_slider_6 = Slider(52, range=0..100)
number_slider_7 = Slider(48, range=0..100)
merge = Merge(Data1=number_slider_4, Data2=number_slider_5, Data3=number_slider_4, Data4=number_slider_5)
merge_2 = Merge(
    Data1=number_slider_6,
    Data2=number_slider_7,
    Data3=number_slider_6,
    Data4=number_slider_7,
    Data5=number_slider_6,
    Data6=number_slider_7)

# ----
pt = ConstructPoint(XCoordinate=Slider(2, range=0..10), YCoordinate="0", ZCoordinate=number_slider_2)
pt_2 = ConstructPoint(XCoordinate=Slider(-1, range=-5..10), YCoordinate="0", ZCoordinate=number_slider_2)
pt_3 = ConstructPoint(XCoordinate=number_slider, YCoordinate="0", ZCoordinate=number_slider)
pt_4 = ConstructPoint(XCoordinate=number_slider_3, YCoordinate="0", ZCoordinate=number_slider_3)
pt_5 = ConstructPoint(XCoordinate=number_slider, YCoordinate="0", ZCoordinate=Slider(5, range=0..10))

# ---- group: Finger Domains
cluster = Cluster(L=get_joint_points.R, A=Slider(0, range=0..10), B=Slider(3, range=0..100), L_2=get_joint_points.R_2)  # -> L_3, L_4
cluster_2 = Cluster(L=get_joint_points.R, A=Slider(4, range=0..10), B=Slider(9, range=0..100), L_2=get_joint_points.R_2)  # -> L_3, L_4
cluster_3 = Cluster(L=get_joint_points.R, A=Slider(10, range=0..30), B=Slider(15, range=0..100), L_2=get_joint_points.R_2)  # -> L_3, L_4
cluster_4 = Cluster(L=get_joint_points.R, A=Slider(16, range=0..30), B=Slider(21, range=0..100), L_2=get_joint_points.R_2)  # -> L_3, L_4
cluster_5 = Cluster(L=get_joint_points.R, A=Slider(22, range=0..30), B=Slider(27, range=0..100), L_2=get_joint_points.R_2)  # -> L_3, L_4

# ----
ln = Line(StartPoint=pt_3, EndPoint=pt_2)
ln_2 = Line(StartPoint=pt_3, EndPoint=pt)
ln_3 = Line(StartPoint=pt, EndPoint=pt_4)
ln_4 = Line(StartPoint=pt_5, EndPoint=pt_4)
ln_5 = Line(StartPoint=pt_2, EndPoint=pt_5)
ln_6 = Line(StartPoint=pt_4, EndPoint=pt_2)

# ---- group: Finger Shape
xz = XZPlane(Origin=Point(0, 0, 0))
polygon = Polygon(Plane=xz, Radius=3, Segments=Slider(8, range=0..10), FilletRadius=0)  # -> Polygon, Length
crv = Curve(polygon.Polygon)
srf = Surface(polygon.Polygon)

# ----
boundary = BoundarySurfaces(Edges=[ln_3, ln_2, ln, ln_4, ln_5])
cluster_6 = Cluster_3(P=cluster.L_3, Z=merge, P_2=cluster.L_4)  # -> pt_5, pt_7, pt_8, pt_6
cluster_7 = Cluster_3(P=cluster_2.L_3, Z=merge_2, P_2=cluster_2.L_4)  # -> pt_5, pt_7, pt_8, pt_6
cluster_8 = Cluster_3(P=cluster_3.L_3, Z=merge_2, P_2=cluster_3.L_4)  # -> pt_5, pt_7, pt_8, pt_6
cluster_9 = Cluster_3(P=cluster_4.L_3, Z=merge_2, P_2=cluster_4.L_4)  # -> pt_5, pt_7, pt_8, pt_6
cluster_10 = Cluster_3(P=cluster_5.L_3, Z=merge_2, P_2=cluster_5.L_4)  # -> pt_5, pt_7, pt_8, pt_6
srf4pt = _4PointSurface(CornerA=cluster_7.pt_5, CornerB=cluster_7.pt_7, CornerC=cluster_7.pt_8, CornerD=cluster_7.pt_6)
srf4pt_2 = _4PointSurface(CornerA=cluster_9.pt_5, CornerB=cluster_9.pt_7, CornerC=cluster_9.pt_8, CornerD=cluster_9.pt_6)
srf4pt_3 = _4PointSurface(CornerA=cluster_10.pt_5, CornerB=cluster_10.pt_7, CornerC=cluster_10.pt_8, CornerD=cluster_10.pt_6)
srf4pt_4 = _4PointSurface(CornerA=cluster_6.pt_5, CornerB=cluster_6.pt_7, CornerC=cluster_6.pt_8, CornerD=cluster_6.pt_6)
srf4pt_5 = _4PointSurface(CornerA=cluster_8.pt_5, CornerB=cluster_8.pt_7, CornerC=cluster_8.pt_8, CornerD=cluster_8.pt_6)
cluster_11 = Cluster_2(C=crv, S=srf, T=srf4pt)
cluster_12 = Cluster_2(C=crv, S=srf, T=srf4pt_2)
cluster_13 = Cluster_2(C=crv, S=srf, T=srf4pt_3)
cluster_14 = Cluster_2(C=crv, S=srf, T=srf4pt_4)
cluster_15 = Cluster_2(C=crv, S=srf, T=srf4pt_5)
loft = Loft(Curves=cluster_11, Options={Adjust=False, Closed=True, LoftEnds=0, LoftSimp=0, LoftType=3, Rebuild=10, Refit=0.01})
loft_2 = Loft(Curves=cluster_12, Options={Adjust=False, Closed=True, LoftEnds=0, LoftSimp=0, LoftType=3, Rebuild=10, Refit=0.01})
loft_3 = Loft(Curves=cluster_13, Options={Adjust=False, Closed=True, LoftEnds=0, LoftSimp=0, LoftType=3, Rebuild=10, Refit=0.01})
loft_4 = Loft(Curves=cluster_14, Options={Adjust=False, Closed=True, LoftEnds=0, LoftSimp=0, LoftType=3, Rebuild=10, Refit=0.01})
loft_5 = Loft(Curves=cluster_15, Options={Adjust=False, Closed=True, LoftEnds=0, LoftSimp=0, LoftType=3, Rebuild=10, Refit=0.01})

# ==== cluster GetJointPoints
F = ClusterInput()
concat = Concatenate(FragmentA="{", FragmentB="0", FragmentC=";", FragmentD="0", FragmentE=";", FragmentF=F, FragmentG="}")
path = DataPath(concat)
T = ClusterInput()
item = TreeItem(Tree=T, Path=path, Index="2", Wrap=True)
item_2 = TreeItem(Tree=T, Path=path, Index="3", Wrap=True)
item_3 = TreeItem(Tree=T, Path=path, Index="0", Wrap=True)
item_4 = TreeItem(Tree=T, Path=path, Index="1", Wrap=True)
_2d_path_to_point = _2DPathToPoint(B=item_3, D=item_4)
_2d_path_to_point_2 = _2DPathToPoint(B=item, D=item_2)
R = ClusterOutput(_2d_path_to_point)
R_2 = ClusterOutput(_2d_path_to_point_2)

# ==== cluster JointCount
L = ClusterInput()
item = ListItem(List=L, Index=0, Wrap=True)
flatten = FlattenTree(Tree=item, Path="{0}")
lng = ListLength(List=flatten)
subtraction = Subtraction(A=lng, B="1")
R = ClusterOutput(subtraction)

# ==== cluster Cluster
A = ClusterInput()
B = ClusterInput()
L = ClusterInput()
L_2 = ClusterInput()
dom = ConstructDomain(DomainStart=A, DomainEnd=B)
dom_2 = ConstructDomain(DomainStart=A, DomainEnd=B)
subset = SubList(List=L, Domain=dom, Wrap=True)  # -> List, Index
subset_2 = SubList(List=L_2, Domain=dom_2, Wrap=True)  # -> List, Index
L_3 = ClusterOutput(subset.List)
L_4 = ClusterOutput(subset_2.List)

# ==== cluster Cluster_2
C = ClusterInput()
S = ClusterInput()
T = ClusterInput()
map_srf = MapToSurface(Curve=C, Source=S, Target=T)
divide = DivideCurve(Curve=map_srf, Count="1", Kinks="True")  # -> Points, Tangents, Parameters
flatten = FlattenTree(Tree=divide.Points, Path="{0}")
count_points = CountPoints(L=divide.Points)
partition = PartitionList(List=flatten, Size=count_points)
partition_2 = PartitionList(List=partition, Size="1")
split = SplitTree(Data=partition_2, Masks=flatten("{0;0;?}"))  # -> Positive, Negative
split_2 = SplitTree(Data=partition_2, Masks=flatten("{0;1;?}"))  # -> Positive, Negative
split_3 = SplitTree(Data=partition_2, Masks=flatten("{0;2;?}"))  # -> Positive, Negative
split_4 = SplitTree(Data=partition_2, Masks=flatten("{0;3;?}"))  # -> Positive, Negative
split_5 = SplitTree(Data=partition_2, Masks=flatten("{0;4;?}"))  # -> Positive, Negative
split_6 = SplitTree(Data=partition_2, Masks=flatten("{0;5;?}"))  # -> Positive, Negative
path_mapper = PathMapper(split_2.Positive, source="{A;B;C}", target="{A;0;C}")
path_mapper_2 = PathMapper(split_3.Positive, source="{A;B;C}", target="{A;0;C}")
path_mapper_3 = PathMapper(split_4.Positive, source="{A;B;C}", target="{A;0;C}")
path_mapper_4 = PathMapper(split_5.Positive, source="{A;B;C}", target="{A;0;C}")
path_mapper_5 = PathMapper(split_6.Positive, source="{A;B;C}", target="{A;0;C}")
merge = Merge(
    Data1=split.Positive,
    Data2=path_mapper,
    Data3=path_mapper_2,
    Data4=path_mapper_3,
    Data5=path_mapper_4,
    Data6=path_mapper_5)
intcrv = Interpolate(Vertices=merge, Degree=3, Periodic=False, KnotStyle=1)  # -> Curve, Length, Domain
flatten_2 = FlattenTree(Tree=intcrv.Curve, Path="{0}")
partition_3 = PartitionList(List=flatten_2, Size=count_points)
C_2 = ClusterOutput(partition_3)

# ==== cluster Cluster_3
P = ClusterInput()
P_2 = ClusterInput()
pdecon = Deconstruct(Point=P)  # -> XComponent, YComponent, ZComponent
pdecon_2 = Deconstruct(Point=P_2)  # -> XComponent, YComponent, ZComponent
Z = ClusterInput()
pt = ConstructPoint(XCoordinate=pdecon.XComponent, YCoordinate=pdecon.YComponent, ZCoordinate=Z)
pt_2 = ConstructPoint(XCoordinate=pdecon_2.XComponent, YCoordinate=pdecon_2.YComponent, ZCoordinate=Z)
pt_3 = Point(P)
pt_4 = Point(P_2)
pt_5 = ClusterOutput(pt)
pt_6 = ClusterOutput(pt_2)
pt_7 = ClusterOutput(pt_3)
pt_8 = ClusterOutput(pt_4)

# ==== cluster _2DPathToPoint
B = ClusterInput()
D = ClusterInput()
concat = Concatenate(FragmentA="{", FragmentB=B, FragmentC=",", FragmentD=D, FragmentE=",", FragmentF="0", FragmentG="}")
pt = Point(concat)
pt_2 = ClusterOutput(pt)

# ==== cluster CountPoints
L = ClusterInput()
lng = ListLength(List=L)
flatten = FlattenTree(Tree=lng, Path="{0}")
item = ListItem(List=flatten, Index=0, Wrap=True)
i = ClusterOutput(item)
