# Grasshopper definition 2D-3D_exo_v0.3.gh (Grasshopper 0.9.76)

panel = Panel("C:\Users\doorn\OneDrive\Docs\Soft-Robotics\NUS SR\Models\2D-3D_EXO\Test Images\output_rens.csv")

# ---- group: Read File
path = FilePath(panel)
file = ReadFile(F=path, PerLineParse=True)  # -> C
#   port F: Uri of file to read
# ---------- file: VB line parser ----------
    action = GH_LineParserAction.Include
    Return line

    'Parse the line and return some data that represents the line.
    'If the line cannot be parsed, you can return Nothing and
    'assign a different action.
    'The default implementation is to just return the line itself.
    'If you return types that implement IGH_Goo, this component
    'will work substantially faster.
# ---------- end file ----------
panel_2 = Panel(file)

# ---- group: Get Joint Coordinates
partition = PartitionList(List=panel_2, Size="4")
joint_count = JointCount(L=partition)
range = Range(Domain=joint_count, Steps=joint_count)
get_joint_points = GetJointPoints(T=partition, F=range)  # -> R, R_2

# ---- group: Input Shape
number_slider = Slider(-4, range=-10..10)
number_slider_2 = Slider(-3, range=-10..10)
number_slider_3 = Slider(-2, range=-10..10)
number_slider_4 = Slider(-1, range=-10..10)
number_slider_5 = Slider(0, range=-10..10)
number_slider_6 = Slider(1, range=-10..10)
number_slider_7 = Slider(2, range=-10..10)
number_slider_8 = Slider(4, range=-10..10)
number_slider_9 = Slider(3, range=-10..10)
pt = ConstructPoint(XCoordinate=number_slider_2, YCoordinate="0", ZCoordinate=number_slider)
pt_2 = ConstructPoint(XCoordinate=number_slider_9, YCoordinate="0", ZCoordinate=number_slider)
pt_3 = ConstructPoint(XCoordinate=number_slider_8, YCoordinate="0", ZCoordinate=number_slider_4)
pt_4 = ConstructPoint(XCoordinate=number_slider_9, YCoordinate="0", ZCoordinate=number_slider_9)
pt_5 = ConstructPoint(XCoordinate=number_slider_8, YCoordinate="0", ZCoordinate=number_slider_6)
pt_6 = ConstructPoint(XCoordinate=number_slider_2, YCoordinate="0", ZCoordinate=number_slider_9)
pt_7 = ConstructPoint(XCoordinate=number_slider, YCoordinate="0", ZCoordinate=number_slider_6)
pt_8 = ConstructPoint(XCoordinate=number_slider, YCoordinate="0", ZCoordinate=number_slider_4)
pt_9 = ConstructPoint(XCoordinate=number_slider_2, YCoordinate="0", ZCoordinate=number_slider)
pline = PolyLine(Vertices=[pt, pt_2, pt_3, pt_5, pt_4, pt_6, pt_7, pt_8, pt_9], Closed=False)
xz = XZPlane(Origin=Point(0, 0, 0))
rotate = Rotate(Geometry=pline, Angle=1.570796327, Plane=xz)  # -> Geometry, Transform
srf = Surface(rotate.Geometry)
crv = Curve(rotate.Geometry)

# ---- group: Finger Domains
cluster = Cluster(L=get_joint_points.R, A=Slider(0, range=0..10), B=Slider(3, range=0..100), L_2=get_joint_points.R_2)  # -> L_3, L_4; disabled
cluster_2 = Cluster(L=get_joint_points.R, A=Slider(4, range=0..10), B=Slider(9, range=0..100), L_2=get_joint_points.R_2)  # -> L_3, L_4; disabled
cluster_3 = Cluster(L=get_joint_points.R, A=Slider(10, range=0..30), B=Slider(15, range=0..100), L_2=get_joint_points.R_2)  # -> L_3, L_4; disabled
cluster_4 = Cluster(L=get_joint_points.R, A=Slider(16, range=0..30), B=Slider(21, range=0..100), L_2=get_joint_points.R_2)  # -> L_3, L_4
cluster_5 = Cluster(L=get_joint_points.R, A=Slider(22, range=0..30), B=Slider(27, range=0..100), L_2=get_joint_points.R_2)  # -> L_3, L_4; disabled

# ---- group: Set Joint Heights
merge = Merge(
    Data1=Slider(48, range=0..100),
    Data2=Slider(48, range=0..100),
    Data3=Slider(48, range=0..100),
    Data4=Slider(48, range=0..100))
merge_2 = Merge(
    Data1=Slider(20, range=0..100),
    Data2=Slider(21, range=0..100),
    Data3=Slider(19, range=0..100),
    Data4=Slider(20, range=0..100),
    Data5=Slider(18, range=0..100),
    Data6=Slider(18, range=0..100))

# ----
swatch = ColourSwatch(SwatchColor=RGB(178, 57, 57))
cluster_6 = Cluster_2(P=cluster.L_3, Z=merge, P_2=cluster.L_4)  # -> pt_5, pt_7, pt_8, pt_6
cluster_7 = Cluster_2(P=cluster_2.L_3, Z=merge_2, P_2=cluster_2.L_4)  # -> pt_5, pt_7, pt_8, pt_6
cluster_8 = Cluster_2(P=cluster_3.L_3, Z=merge_2, P_2=cluster_3.L_4)  # -> pt_5, pt_7, pt_8, pt_6
cluster_9 = Cluster_2(P=cluster_4.L_3, Z=merge_2, P_2=cluster_4.L_4)  # -> pt_5, pt_7, pt_8, pt_6
cluster_10 = Cluster_2(P=cluster_5.L_3, Z=merge_2, P_2=cluster_5.L_4)  # -> pt_5, pt_7, pt_8, pt_6
srf4pt = _4PointSurface(CornerA=cluster_7.pt_5, CornerB=cluster_7.pt_7, CornerC=cluster_7.pt_8, CornerD=cluster_7.pt_6)
srf4pt_2 = _4PointSurface(CornerA=cluster_9.pt_5, CornerB=cluster_9.pt_7, CornerC=cluster_9.pt_8, CornerD=cluster_9.pt_6)
srf4pt_3 = _4PointSurface(CornerA=cluster_10.pt_5, CornerB=cluster_10.pt_7, CornerC=cluster_10.pt_8, CornerD=cluster_10.pt_6)
srf4pt_4 = _4PointSurface(CornerA=cluster_6.pt_5, CornerB=cluster_6.pt_7, CornerC=cluster_6.pt_8, CornerD=cluster_6.pt_6)
srf4pt_5 = _4PointSurface(CornerA=cluster_8.pt_5, CornerB=cluster_8.pt_7, CornerC=cluster_8.pt_8, CornerD=cluster_8.pt_6)
loft_geo = LoftGeo(D=Slider(3, range=0..10), C=crv, S=srf, T=srf4pt_4)
loft_geo_2 = LoftGeo(D=Slider(3, range=0..10), C=crv, S=srf, T=srf4pt)
loft_geo_3 = LoftGeo(D=Slider(1, range=0..10), C=crv, S=srf, T=srf4pt_5)
cluster_11 = Cluster_3(L=srf4pt_5, L_2=cluster_8.pt_7, L_3=cluster_8.pt_8, A=loft_geo_3, L_4=cluster_8.pt_5, L_5=cluster_8.pt_6)
loft_geo_4 = LoftGeo(D=Slider(1, range=0..10), C=crv, S=srf, T=srf4pt_2)
loft_geo_5 = LoftGeo(D=Slider(3, range=0..10), C=crv, S=srf, T=srf4pt_3)
cluster_12 = Cluster_3(L=srf4pt_2, L_2=cluster_9.pt_7, L_3=cluster_9.pt_8, A=loft_geo_4, L_4=cluster_9.pt_5, L_5=cluster_9.pt_6)
cluster_13 = Cluster_3(L=srf4pt, L_2=cluster_7.pt_7, L_3=cluster_7.pt_8, A=loft_geo_2, L_4=cluster_7.pt_5, L_5=cluster_7.pt_6)
preview = CustomPreview(Geometry=cluster_11, Shader=swatch)
preview_2 = CustomPreview(Geometry=cluster_12, Shader=swatch)
preview_3 = CustomPreview(Geometry=cluster_13, Shader=swatch)
range_2 = Range(Domain=Slider(4, range=0..10), Steps=Slider(2, range=0..10))
range_3 = Range(Domain=Slider(6, range=0..10), Steps=Slider(3, range=0..10))
extrude_cut_polygon = ExtrudeCutPolygon(
    L=srf4pt_4,
    L_2=cluster_6.pt_7,
    L_3=cluster_6.pt_8,
    i=range_2,
    B=Slider(3, range=0..10),
    R=Slider(24, range=0..100),
    S=Slider(3, range=0..10),
    rf=Slider(3, range=0..10),
    A=Slider(45, range=0..100))
extrude_cut_polygon_2 = ExtrudeCutPolygon(
    L=srf4pt_4,
    L_2=cluster_6.pt_5,
    L_3=cluster_6.pt_6,
    i=range_2,
    B=Slider(3, range=0..10),
    R=Slider(20, range=0..100),
    S=Slider(4, range=0..10),
    rf=Slider(3, range=0..10),
    A=Slider(0, range=0..100))
extrude_cut_polygon_3 = ExtrudeCutPolygon(
    L=srf4pt_3,
    L_2=cluster_10.pt_7,
    L_3=cluster_10.pt_8,
    i=range_3,
    B=Slider(3, range=0..10),
    R=Slider(24, range=0..100),
    S=Slider(3, range=0..10),
    rf=Slider(3, range=0..10),
    A=Slider(45, range=0..100))
extrude_cut_polygon_4 = ExtrudeCutPolygon(
    L=srf4pt_3,
    L_2=cluster_10.pt_5,
    L_3=cluster_10.pt_6,
    i=range_3,
    B=Slider(3, range=0..10),
    R=Slider(20, range=0..100),
    S=Slider(4, range=0..10),
    rf=Slider(3, range=0..10),
    A=Slider(0, range=0..100))
sdiff = SolidDifference(BrepsA=loft_geo, BrepsB=extrude_cut_polygon)
sdiff_2 = SolidDifference(BrepsA=loft_geo_5, BrepsB=extrude_cut_polygon_3)
sdiff_3 = SolidDifference(BrepsA=sdiff, BrepsB=extrude_cut_polygon_2)
sdiff_4 = SolidDifference(BrepsA=sdiff_2, BrepsB=extrude_cut_polygon_4)
preview_4 = CustomPreview(Geometry=sdiff_3, Shader=swatch)
preview_5 = CustomPreview(Geometry=sdiff_4, Shader=swatch)

# ==== cluster GetJointPoints
F = ClusterInput()
concat = Concatenate(FragmentA="{", FragmentB="0", FragmentC=";", FragmentD="0", FragmentE=";", FragmentF=F, FragmentG="}")
path = DataPath(concat)
T = ClusterInput()
item = TreeItem(Tree=T, Path=path, Index="2", Wrap=True)
item_2 = TreeItem(Tree=T, Path=path, Index="3", Wrap=True)
item_3 = TreeItem(Tree=T, Path=path, Index="0", Wrap=True)
item_4 = TreeItem(Tree=T, Path=path, Index="1", Wrap=True)
_2d_path_to_point = _2DPathToPoint(B=item_3, D=item_4)
_2d_path_to_point_2 = _2DPathToPoint(B=item, D=item_2)
R = ClusterOutput(_2d_path_to_point)
R_2 = ClusterOutput(_2d_path_to_point_2)

# ==== cluster JointCount
L = ClusterInput()
item = ListItem(List=L, Index=0, Wrap=True)
flatten = FlattenTree(Tree=item, Path="{0}")
lng = ListLength(List=flatten)
subtraction = Subtraction(A=lng, B="1")
R = ClusterOutput(subtraction)

# ==== cluster Cluster
A = ClusterInput()
B = ClusterInput()
L = ClusterInput()
L_2 = ClusterInput()
dom = ConstructDomain(DomainStart=A, DomainEnd=B)
dom_2 = ConstructDomain(DomainStart=A, DomainEnd=B)
subset = SubList(List=L, Domain=dom, Wrap=True)  # -> List, Index
subset_2 = SubList(List=L_2, Domain=dom_2, Wrap=True)  # -> List, Index
L_3 = ClusterOutput(subset.List)
L_4 = ClusterOutput(subset_2.List)

# ==== cluster Cluster_2
P = ClusterInput()
P_2 = ClusterInput()
pdecon = Deconstruct(Point=P)  # -> XComponent, YComponent, ZComponent
pdecon_2 = Deconstruct(Point=P_2)  # -> XComponent, YComponent, ZComponent
Z = ClusterInput()
pt = ConstructPoint(XCoordinate=pdecon.XComponent, YCoordinate=pdecon.YComponent, ZCoordinate=Z)
pt_2 = ConstructPoint(XCoordinate=pdecon_2.XComponent, YCoordinate=pdecon_2.YComponent, ZCoordinate=Z)
pt_3 = Point(P)
pt_4 = Point(P_2)
pt_5 = ClusterOutput(pt)
pt_6 = ClusterOutput(pt_2)
pt_7 = ClusterOutput(pt_3)
pt_8 = ClusterOutput(pt_4)

# ==== cluster LoftGeo
C = ClusterInput()
S = ClusterInput()
T = ClusterInput()
deplane = DeconstructPlane(Plane=T)  # -> Origin, XAxis, YAxis, ZAxis
pdecon = Deconstruct(Point=deplane.Origin)  # -> XComponent, YComponent, ZComponent
subtraction = Subtraction(A=pdecon.ZComponent, B=Slider(1, range=0..10))
pt = ConstructPoint(XCoordinate=pdecon.XComponent, YCoordinate=pdecon.YComponent, ZCoordinate=subtraction)
pl = ConstructPlane(Origin=pt, XAxis=deplane.XAxis, YAxis=deplane.YAxis)
map_srf = MapToSurface(Curve=C, Source=S, Target=T)
D = ClusterInput()
rectangle = Rectangle(Plane=pl, XSize=Slider(-100, range=-100..100), YSize=Slider(100, range=-100..100), Radius=0)  # -> Rectangle, Length
offset = Offset(Curve=map_srf, Distance=D, Plane=S, Corners=1)
loft_edges = LoftEdges(C=offset)
loft_edges_2 = LoftEdges(C=map_srf)
loft_edges_3 = LoftEdges(C=rectangle.Rectangle)
loft = Loft(Curves=loft_edges_3, Options={Adjust=False, Closed=True, LoftEnds=0, LoftSimp=0, LoftType=3, Rebuild=10, Refit=0.01})
loft_2 = Loft(Curves=loft_edges, Options={Adjust=False, Closed=True, LoftEnds=0, LoftSimp=0, LoftType=3, Rebuild=10, Refit=0.01})
loft_3 = Loft(Curves=loft_edges_2, Options={Adjust=False, Closed=True, LoftEnds=0, LoftSimp=0, LoftType=3, Rebuild=10, Refit=0.01})
cap = CapHoles(Brep=loft)
cap_2 = CapHoles(Brep=loft_2)
cap_3 = CapHoles(Brep=loft_3)
sdiff = SolidDifference(BrepsA=cap_2, BrepsB=[cap_3, cap])
R = ClusterOutput(sdiff)

# ==== cluster ExtrudeCutPolygon
B = ClusterInput()
L = ClusterInput()
L_2 = ClusterInput()
L_3 = ClusterInput()
i = ClusterInput()
item = ListItem(List=L, Index=i, Wrap=True)
item_2 = ListItem(List=L_2, Index=i, Wrap=True)
item_3 = ListItem(List=L_3, Index=i, Wrap=True)
pdecon = Deconstruct(Point=item_2)  # -> XComponent, YComponent, ZComponent
pdecon_2 = Deconstruct(Point=item_3)  # -> XComponent, YComponent, ZComponent
addition = Addition(A=pdecon.ZComponent, B=B)
addition_2 = Addition(A=B, B=pdecon_2.ZComponent)
pt = ConstructPoint(XCoordinate=pdecon.XComponent, YCoordinate=pdecon.YComponent, ZCoordinate=addition)
pt_2 = ConstructPoint(XCoordinate=pdecon_2.XComponent, YCoordinate=pdecon_2.YComponent, ZCoordinate=addition_2)
ln = Line(StartPoint=pt, EndPoint=pt_2)
deplane = DeconstructPlane(Plane=item)  # -> Origin, XAxis, YAxis, ZAxis
ext = ExtendCurve(Curve=ln, Type=0, Start="10", End="10")
end = EndPoints(Curve=ext)  # -> Start, End
R = ClusterInput()
S = ClusterInput()
rf = ClusterInput()
A = ClusterInput()
pl = ConstructPlane(Origin=end.Start, XAxis=deplane.XAxis, YAxis=deplane.ZAxis)
polygon = Polygon(Plane=pl, Radius=R, Segments=S, FilletRadius=rf)  # -> Polygon, Length
rotate = Rotate(Geometry=polygon.Polygon, Angle=A, Plane=pl)  # -> Geometry, Transform
extrcrv = ExtrudeAlong(Base=rotate.Geometry, Curve=ext)
cap = CapHoles(Brep=extrcrv)
B_2 = ClusterOutput(cap)

# ==== cluster Cluster_3
range = Range(Domain=Slider(6, range=0..10), Steps=Slider(3, range=0..10))
L = ClusterInput()
L_2 = ClusterInput()
L_3 = ClusterInput()
L_4 = ClusterInput()
L_5 = ClusterInput()
extrude_cut_polygon = ExtrudeCutPolygon(
    L=L,
    L_2=L_2,
    L_3=L_3,
    i=range,
    B=Slider(3, range=0..10),
    R=Slider(8, range=0..100),
    S=Slider(3, range=0..10),
    rf=Slider(1, range=0..10),
    A=Slider(45, range=0..100))
extrude_cut_polygon_2 = ExtrudeCutPolygon(
    L=L,
    L_2=L_4,
    L_3=L_5,
    i=range,
    B=Slider(3, range=0..10),
    R=Slider(9, range=0..100),
    S=Slider(4, range=0..10),
    rf=Slider(1, range=0..10),
    A=Slider(0, range=0..100))
A = ClusterInput()
sdiff = SolidDifference(BrepsA=A, BrepsB=extrude_cut_polygon)
sdiff_2 = SolidDifference(BrepsA=sdiff, BrepsB=extrude_cut_polygon_2)
R = ClusterOutput(sdiff_2)

# ==== cluster _2DPathToPoint
B = ClusterInput()
D = ClusterInput()
concat = Concatenate(FragmentA="{", FragmentB=B, FragmentC=",", FragmentD=D, FragmentE=",", FragmentF="0", FragmentG="}")
pt = Point(concat)
pt_2 = ClusterOutput(pt)

# ==== cluster LoftEdges
C = ClusterInput()
divide = DivideCurve(Curve=C, Count="1", Kinks="True")  # -> Points, Tangents, Parameters
flatten = FlattenTree(Tree=divide.Points, Path="{0}")
count_points = CountPoints(L=divide.Points)
partition = PartitionList(List=flatten, Size=count_points)
partition_2 = PartitionList(List=partition, Size="1")
split = SplitTree(Data=partition_2, Masks=flatten("{0;0;?}"))  # -> Positive, Negative
split_2 = SplitTree(Data=partition_2, Masks=flatten("{0;1;?}"))  # -> Positive, Negative
split_3 = SplitTree(Data=partition_2, Masks=flatten("{0;2;?}"))  # -> Positive, Negative
split_4 = SplitTree(Data=partition_2, Masks=flatten("{0;3;?}"))  # -> Positive, Negative
split_5 = SplitTree(Data=partition_2, Masks=flatten("{0;4;?}"))  # -> Positive, Negative
split_6 = SplitTree(Data=partition_2, Masks=flatten("{0;5;?}"))  # -> Positive, Negative
path_mapper = PathMapper(split_2.Positive, source="{A;B;C}", target="{A;0;C}")
path_mapper_2 = PathMapper(split_3.Positive, source="{A;B;C}", target="{A;0;C}")
path_mapper_3 = PathMapper(split_4.Positive, source="{A;B;C}", target="{A;0;C}")
path_mapper_4 = PathMapper(split_5.Positive, source="{A;B;C}", target="{A;0;C}")
path_mapper_5 = PathMapper(split_6.Positive, source="{A;B;C}", target="{A;0;C}")
merge = Merge(
    Data1=split.Positive,
    Data2=path_mapper,
    Data3=path_mapper_2,
    Data4=path_mapper_3,
    Data5=path_mapper_4,
    Data6=path_mapper_5)
intcrv = Interpolate(Vertices=merge, Degree=3, Periodic=False, KnotStyle=1)  # -> Curve, Length, Domain
flatten_2 = FlattenTree(Tree=intcrv.Curve, Path="{0}")
partition_3 = PartitionList(List=flatten_2, Size=count_points)
C_2 = ClusterOutput(partition_3)

# ==== cluster CountPoints
L = ClusterInput()
lng = ListLength(List=L)
flatten = FlattenTree(Tree=lng, Path="{0}")
item = ListItem(List=flatten, Index=0, Wrap=True)
i = ClusterOutput(item)
