# Grasshopper definition 2D-3D_exo_v1.0.gh (Grasshopper 0.9.76)

# ---- group: Read File
path = FilePath("~\Test Images\output.csv")
file = ReadFile(F=path, PerLineParse=True)  # -> C
#   port F: Uri of file to read
# ---------- file: VB line parser ----------
    action = GH_LineParserAction.Include
    Return line

    'Parse the line and return some data that represents the line.
    'If the line cannot be parsed, you can return Nothing and
    'assign a different action.
    'The default implementation is to just return the line itself.
    'If you return types that implement IGH_Goo, this component
    'will work substantially faster.
# ---------- end file ----------
panel = Panel(file)

# ---- group: Get Joint Coordinates
partition = PartitionList(List=panel, Size="4")
joint_count = JointCount(L=partition)
range = Range(Domain=joint_count, Steps=joint_count)
get_joint_points = GetJointPoints(T=partition, F=range)  # -> R, R_2

# ---- group: Input Shape
number_slider = Slider(-4, range=-10..10)
number_slider_2 = Slider(0, range=-10..10)
number_slider_3 = Slider(1, range=-10..10)
number_slider_4 = Slider(-3, range=-10..10)
number_slider_5 = Slider(-1, range=-10..10)
number_slider_6 = Slider(3, range=-10..10)
number_slider_7 = Slider(4, range=-10..10)
pt = ConstructPoint(XCoordinate=number_slider_4, YCoordinate="0", ZCoordinate=number_slider)
pt_2 = ConstructPoint(XCoordinate=number_slider_6, YCoordinate="0", ZCoordinate=number_slider)
pt_3 = ConstructPoint(XCoordinate=number_slider_7, YCoordinate="0", ZCoordinate=number_slider_5)
pt_4 = ConstructPoint(XCoordinate=Slider(2.5, range=-10..10), YCoordinate="0", ZCoordinate=number_slider_6)
pt_5 = ConstructPoint(XCoordinate=number_slider_7, YCoordinate="0", ZCoordinate=number_slider_3)
pt_6 = ConstructPoint(XCoordinate=Slider(-2.5, range=-10..10), YCoordinate="0", ZCoordinate=number_slider_6)
pt_7 = ConstructPoint(XCoordinate=number_slider, YCoordinate="0", ZCoordinate=number_slider_3)
pt_8 = ConstructPoint(XCoordinate=number_slider, YCoordinate="0", ZCoordinate=number_slider_5)
pt_9 = ConstructPoint(XCoordinate=number_slider_4, YCoordinate="0", ZCoordinate=number_slider)
pline = PolyLine(Vertices=[pt, pt_2, pt_3, pt_5, pt_4, pt_6, pt_7, pt_8, pt_9], Closed=False)
xz = XZPlane(Origin=Point(0, 0, 0))
rotate = Rotate(Geometry=pline, Angle=1.570796327, Plane=xz)  # -> Geometry, Transform
srf = Surface(rotate.Geometry)
crv = Curve(rotate.Geometry)

# ----
number_slider_8 = Slider(2.5, range=0..10)

# ---- group: Finger Coords Domains
extract = Extract(L=get_joint_points.R, A=Slider(0, range=0..10), B=Slider(3, range=0..100), L_2=get_joint_points.R_2)  # -> L_3, L_4; disabled
extract_2 = Extract(L=get_joint_points.R, A=Slider(4, range=0..10), B=Slider(9, range=0..100), L_2=get_joint_points.R_2)  # -> L_3, L_4
extract_3 = Extract(L=get_joint_points.R, A=Slider(10, range=0..30), B=Slider(15, range=0..100), L_2=get_joint_points.R_2)  # -> L_3, L_4
extract_4 = Extract(L=get_joint_points.R, A=Slider(16, range=0..30), B=Slider(21, range=0..100), L_2=get_joint_points.R_2)  # -> L_3, L_4
extract_5 = Extract(L=get_joint_points.R, A=Slider(22, range=0..30), B=Slider(27, range=0..100), L_2=get_joint_points.R_2)  # -> L_3, L_4

# ---- group: Thumb Heights
joint_1 = Slider(20, range=0..100)
phalanx_1 = Slider(21, range=0..100)
joint_2 = Slider(19, range=0..100)
phalanx_2 = Slider(20, range=0..100)
merge = Merge(Data1=joint_1, Data2=phalanx_1, Data3=joint_2, Data4=phalanx_2)

# ---- group: Finger Heights
joint_1_2 = Slider(17.8, range=0..100)
phalanx_1_2 = Slider(18.1, range=0..100)
joint_3 = Slider(12.6, range=0..100)
phalanx_3 = Slider(13, range=0..100)
joint_2_2 = Slider(16.8, range=0..100)
phalanx_2_2 = Slider(14, range=0..100)
merge_2 = Merge(Data1=joint_1_2, Data2=phalanx_1_2, Data3=joint_2_2, Data4=phalanx_2_2, Data5=joint_3, Data6=phalanx_3)

# ---- group: Offset Coords
offset_height = OffsetHeight(P=extract.L_3, Z=merge, P_2=extract.L_4)  # -> pt_5, pt_7, pt_8, pt_6
offset_height_2 = OffsetHeight(P=extract_2.L_3, Z=merge_2, P_2=extract_2.L_4)  # -> pt_5, pt_7, pt_8, pt_6
offset_height_3 = OffsetHeight(P=extract_3.L_3, Z=merge_2, P_2=extract_3.L_4)  # -> pt_5, pt_7, pt_8, pt_6
offset_height_4 = OffsetHeight(P=extract_4.L_3, Z=merge_2, P_2=extract_4.L_4)  # -> pt_5, pt_7, pt_8, pt_6
offset_height_5 = OffsetHeight(P=extract_5.L_3, Z=merge_2, P_2=extract_5.L_4)  # -> pt_5, pt_7, pt_8, pt_6

# ---- group: Create sSurfaces from Coords
srf4pt = _4PointSurface(CornerA=offset_height.pt_5, CornerB=offset_height.pt_7, CornerC=offset_height.pt_8, CornerD=offset_height.pt_6)
srf4pt_2 = _4PointSurface(CornerA=offset_height_2.pt_5, CornerB=offset_height_2.pt_7, CornerC=offset_height_2.pt_8, CornerD=offset_height_2.pt_6)
srf4pt_3 = _4PointSurface(CornerA=offset_height_3.pt_5, CornerB=offset_height_3.pt_7, CornerC=offset_height_3.pt_8, CornerD=offset_height_3.pt_6)
srf4pt_4 = _4PointSurface(CornerA=offset_height_4.pt_5, CornerB=offset_height_4.pt_7, CornerC=offset_height_4.pt_8, CornerD=offset_height_4.pt_6)
srf4pt_5 = _4PointSurface(CornerA=offset_height_5.pt_5, CornerB=offset_height_5.pt_7, CornerC=offset_height_5.pt_8, CornerD=offset_height_5.pt_6)

# ---- group: Settings
joint_middle_offset = Slider(2, range=0..10)
tendon_thickness = Slider(0.4, range=0..1)
tendon_outside = Slider(0, range=0..10)
tendon_inside = Slider(3, range=0..10)
tendon_length = Slider(65, range=0..100)
wall_thickness = Slider(1.2, range=0..10)
tendon_offset = Slider(1.6, range=0..5)
tendon_width = Slider(2.5, range=0..10)
guide_offset = Slider(2.5, range=0..10)
guide_height = Slider(6, range=0..10)
shape_offset = Slider(0, range=-10..10)
guide_width = Slider(4, range=0..10)
joint_width = Slider(1.25, range=0..10)
joint_fillet = Slider(1, range=0..10)

# ---- group: Lofts
loft_geo = LoftGeo(D_2=wall_thickness, S=srf, C=crv, D=shape_offset, T=srf4pt, A=offset_height.pt_5, B=offset_height.pt_6)
loft_geo_2 = LoftGeo(D_2=wall_thickness, S=srf, C=crv, D=shape_offset, T=srf4pt_2, A=offset_height_2.pt_5, B=offset_height_2.pt_6)
loft_geo_3 = LoftGeo(D_2=wall_thickness, S=srf, C=crv, D=shape_offset, T=srf4pt_3, A=offset_height_3.pt_5, B=offset_height_3.pt_6)
loft_geo_4 = LoftGeo(D_2=wall_thickness, S=srf, C=crv, D=shape_offset, T=srf4pt_4, A=offset_height_4.pt_5, B=offset_height_4.pt_6)
loft_geo_5 = LoftGeo(D_2=wall_thickness, S=srf, C=crv, D=shape_offset, T=srf4pt_5, A=offset_height_5.pt_5, B=offset_height_5.pt_6)

# ---- group: Cut Joints
cut_joints = CutJoints(
    L=srf4pt,
    A=loft_geo,
    L_2=offset_height.pt_5,
    L_3=offset_height.pt_6,
    L_4=offset_height.pt_7,
    L_5=offset_height.pt_8,
    x=shape_offset,
    B=joint_width,
    rf=joint_fillet,
    B_2=joint_middle_offset)
cut_joints_2 = CutJoints(
    L=srf4pt_2,
    A=loft_geo_2,
    L_2=offset_height_2.pt_5,
    L_3=offset_height_2.pt_6,
    L_4=offset_height_2.pt_7,
    L_5=offset_height_2.pt_8,
    x=shape_offset,
    B=joint_width,
    rf=joint_fillet,
    B_2=joint_middle_offset)
cut_joints_3 = CutJoints(
    L=srf4pt_3,
    A=loft_geo_3,
    L_2=offset_height_3.pt_5,
    L_3=offset_height_3.pt_6,
    L_4=offset_height_3.pt_7,
    L_5=offset_height_3.pt_8,
    x=shape_offset,
    B=joint_width,
    rf=joint_fillet,
    B_2=joint_middle_offset)
cut_joints_4 = CutJoints(
    L=srf4pt_4,
    A=loft_geo_4,
    L_2=offset_height_4.pt_5,
    L_3=offset_height_4.pt_6,
    L_4=offset_height_4.pt_7,
    L_5=offset_height_4.pt_8,
    x=shape_offset,
    B=joint_width,
    rf=joint_fillet,
    B_2=joint_middle_offset)
cut_joints_5 = CutJoints(
    L=srf4pt_5,
    A=loft_geo_5,
    L_2=offset_height_5.pt_5,
    L_3=offset_height_5.pt_6,
    L_4=offset_height_5.pt_7,
    L_5=offset_height_5.pt_8,
    x=shape_offset,
    B=joint_width,
    rf=joint_fillet,
    B_2=joint_middle_offset)

# ---- group: Tendons
cluster = Cluster(
    B=wall_thickness,
    A=shape_offset,
    B_2=tendon_offset,
    B_3=guide_offset,
    A_2=tendon_width,
    B_4=tendon_thickness,
    l0=tendon_outside,
    x=tendon_inside,
    x_2=tendon_length,
    C=crv,
    S=srf,
    T=srf4pt)
cluster_2 = Cluster(
    B=wall_thickness,
    A=shape_offset,
    B_2=tendon_offset,
    B_3=guide_offset,
    A_2=tendon_width,
    B_4=tendon_thickness,
    l0=tendon_outside,
    x=tendon_inside,
    x_2=tendon_length,
    C=crv,
    S=srf,
    T=srf4pt_2)
cluster_3 = Cluster(
    B=wall_thickness,
    A=shape_offset,
    B_2=tendon_offset,
    B_3=guide_offset,
    A_2=tendon_width,
    B_4=tendon_thickness,
    l0=tendon_outside,
    x=tendon_inside,
    x_2=tendon_length,
    C=crv,
    S=srf,
    T=srf4pt_3)
cluster_4 = Cluster(
    B=wall_thickness,
    A=shape_offset,
    B_2=tendon_offset,
    B_3=guide_offset,
    A_2=tendon_width,
    B_4=tendon_thickness,
    l0=tendon_outside,
    x=tendon_inside,
    x_2=tendon_length,
    C=crv,
    S=srf,
    T=srf4pt_4)
cluster_5 = Cluster(
    B=wall_thickness,
    A=shape_offset,
    B_2=tendon_offset,
    B_3=guide_offset,
    A_2=tendon_width,
    B_4=tendon_thickness,
    l0=tendon_outside,
    x=tendon_inside,
    x_2=tendon_length,
    C=crv,
    S=srf,
    T=srf4pt_5)

# ---- group: Guides
create_guides = CreateGuides(B=wall_thickness, B_2=shape_offset, D=guide_offset, Z=guide_height, A=guide_width, S=srf, C=crv, G=srf4pt)
create_guides_2 = CreateGuides(B=wall_thickness, B_2=shape_offset, D=guide_offset, Z=guide_height, A=guide_width, S=srf, C=crv, G=srf4pt_2)
create_guides_3 = CreateGuides(B=wall_thickness, B_2=shape_offset, D=guide_offset, Z=guide_height, A=guide_width, S=srf, C=crv, G=srf4pt_3)
create_guides_4 = CreateGuides(B=wall_thickness, B_2=shape_offset, D=guide_offset, Z=guide_height, A=guide_width, S=srf, C=crv, G=srf4pt_4)
create_guides_5 = CreateGuides(B=wall_thickness, B_2=shape_offset, D=guide_offset, Z=guide_height, A=guide_width, S=srf, C=crv, G=srf4pt_5)

# ----
flatten = FlattenTree(Tree=create_guides, Path="{0}")
simplify = SimplifyTree(Tree=flatten, Front=False)
item = ListItem(List=simplify, Index="0", Wrap=True)

# ---- group: Merge & Preview
swatch = ColourSwatch(SwatchColor=RGB(178, 57, 57))
mjoin = MeshJoin(Meshes=[cut_joints, item, cluster])
mjoin_2 = MeshJoin(Meshes=[create_guides_2, cut_joints_2, cluster_2])
mjoin_3 = MeshJoin(Meshes=[create_guides_3, cut_joints_3, cluster_3])
mjoin_4 = MeshJoin(Meshes=[create_guides_4, cut_joints_4, cluster_4])
mjoin_5 = MeshJoin(Meshes=[cut_joints_5, create_guides_5, cluster_5])
preview = CustomPreview(Geometry=mjoin, Shader=swatch)
preview_2 = CustomPreview(Geometry=mjoin_2, Shader=swatch)
preview_3 = CustomPreview(Geometry=mjoin_3, Shader=swatch)
preview_4 = CustomPreview(Geometry=mjoin_4, Shader=swatch)
preview_5 = CustomPreview(Geometry=mjoin_5, Shader=swatch)

# ==== cluster GetJointPoints
F = ClusterInput()
concat = Concatenate(FragmentA="{", FragmentB="0", FragmentC=";", FragmentD="0", FragmentE=";", FragmentF=F, FragmentG="}")
T = ClusterInput()
path = DataPath(concat)
item = TreeItem(Tree=T, Path=path, Index="2", Wrap=True)
item_2 = TreeItem(Tree=T, Path=path, Index="3", Wrap=True)
item_3 = TreeItem(Tree=T, Path=path, Index="0", Wrap=True)
item_4 = TreeItem(Tree=T, Path=path, Index="1", Wrap=True)
_2d_path_to_point = _2DPathToPoint(B=item_3, D=item_4)
_2d_path_to_point_2 = _2DPathToPoint(B=item, D=item_2)
R = ClusterOutput(_2d_path_to_point)
R_2 = ClusterOutput(_2d_path_to_point_2)

# ==== cluster JointCount
L = ClusterInput()
item = ListItem(List=L, Index=0, Wrap=True)
flatten = FlattenTree(Tree=item, Path="{0}")
lng = ListLength(List=flatten)
subtraction = Subtraction(A=lng, B="1")
R = ClusterOutput(subtraction)

# ==== cluster Extract
L = ClusterInput()
A = ClusterInput()
B = ClusterInput()
L_2 = ClusterInput()
dom = ConstructDomain(DomainStart=A, DomainEnd=B)
dom_2 = ConstructDomain(DomainStart=A, DomainEnd=B)
subset = SubList(List=L, Domain=dom, Wrap=True)  # -> List, Index
subset_2 = SubList(List=L_2, Domain=dom_2, Wrap=True)  # -> List, Index
L_3 = ClusterOutput(subset.List)
L_4 = ClusterOutput(subset_2.List)

# ==== cluster OffsetHeight
Z = ClusterInput()
P = ClusterInput()
P_2 = ClusterInput()
pdecon = Deconstruct(Point=P)  # -> XComponent, YComponent, ZComponent
pdecon_2 = Deconstruct(Point=P_2)  # -> XComponent, YComponent, ZComponent
pt = ConstructPoint(XCoordinate=pdecon.XComponent, YCoordinate=pdecon.YComponent, ZCoordinate=Z)
pt_2 = ConstructPoint(XCoordinate=pdecon_2.XComponent, YCoordinate=pdecon_2.YComponent, ZCoordinate=Z)
pt_3 = Point(P)
pt_4 = Point(P_2)
pt_5 = ClusterOutput(pt)
pt_6 = ClusterOutput(pt_2)
pt_7 = ClusterOutput(pt_3)
pt_8 = ClusterOutput(pt_4)

# ==== cluster LoftGeo
D = ClusterInput()
T = ClusterInput()
deplane = DeconstructPlane(Plane=T)  # -> Origin, XAxis, YAxis, ZAxis
pdecon = Deconstruct(Point=deplane.Origin)  # -> XComponent, YComponent, ZComponent
subtraction = Subtraction(A=pdecon.ZComponent, B="0.5")
addition = Addition(A=subtraction, B=D)
D_2 = ClusterInput()
S = ClusterInput()
C = ClusterInput()
pt = ConstructPoint(XCoordinate=pdecon.XComponent, YCoordinate=pdecon.YComponent, ZCoordinate=addition)
pl = ConstructPlane(Origin=pt, XAxis=deplane.XAxis, YAxis=deplane.YAxis)
map_srf = MapToSurface(Curve=C, Source=S, Target=T)
A = ClusterInput()
B = ClusterInput()
addition_2 = Addition(A=D_2, B="0.5")
offset = Offset(Curve=map_srf, Distance=D, Plane=S, Corners=1)
width = Distance(PointA=A, PointB=B)
neg = Negative(Value=addition_2)
offset_2 = Offset(Curve=offset, Distance=D_2, Plane=S, Corners=1)
rectangle = Rectangle(Plane=pl, XSize=neg, YSize=width, Radius=0)  # -> Rectangle, Length
loft_edges = LoftEdges(C=offset_2)
loft_edges_2 = LoftEdges(C=offset)
loft_edges_3 = LoftEdges(C=rectangle.Rectangle)
loft = Loft(Curves=loft_edges_3, Options={Adjust=False, Closed=True, LoftEnds=0, LoftSimp=0, LoftType=3, Rebuild=10, Refit=0.01})
loft_2 = Loft(Curves=loft_edges, Options={Adjust=False, Closed=True, LoftEnds=0, LoftSimp=0, LoftType=3, Rebuild=10, Refit=0.01})
loft_3 = Loft(Curves=loft_edges_2, Options={Adjust=False, Closed=True, LoftEnds=0, LoftSimp=0, LoftType=3, Rebuild=10, Refit=0.01})
cap = CapHoles(Brep=loft)
cap_2 = CapHoles(Brep=loft_2)
cap_3 = CapHoles(Brep=loft_3)
sdiff = SolidDifference(BrepsA=cap_2, BrepsB=[cap_3, cap])
R = ClusterOutput(sdiff)

# ==== cluster CutJoints
L = ClusterInput()
lng = ListLength(List=L)
subtraction = Subtraction(A=lng, B="2")
division = Division(A=subtraction, B="2")
range = Range(Domain=subtraction, Steps=division)
x = ClusterInput()
B = ClusterInput()
rf = ClusterInput()
B_2 = ClusterInput()
addition = Addition(A=x, B=B)
addition_2 = Addition(A=addition, B="2")
L_2 = ClusterInput()
L_3 = ClusterInput()
L_4 = ClusterInput()
height = Distance(PointA=L_2, PointB=L_4)
item = ListItem(List=height, Index=range, Wrap=True)
subtraction_2 = Subtraction(A=item, B=B)
division_2 = Division(A=subtraction_2, B="2")
subtraction_3 = Subtraction(A=division_2, B=B_2)
addition_3 = Addition(A=division_2, B=B_2)
addition_4 = Addition(A=addition_2, B=subtraction_3)
L_5 = ClusterInput()
neg = Negative(Value=x)
A = ClusterInput()
extrude_cut_polygon = ExtrudeCutPolygon(L=L, L_2=L_2, L_3=L_3, i=range, B=addition_2, R=addition_4, S="4", rf=rf, A="0")
extrude_cut_polygon_2 = ExtrudeCutPolygon(L=L, L_2=L_4, L_3=L_5, i=range, B=neg, R=addition_3, S="3", rf=rf, A="45")
sdiff = SolidDifference(BrepsA=A, BrepsB=extrude_cut_polygon)
sdiff_2 = SolidDifference(BrepsA=sdiff, BrepsB=extrude_cut_polygon_2)
R = ClusterOutput(sdiff_2)

# ==== cluster CreateGuides
B = ClusterInput()
B_2 = ClusterInput()
D = ClusterInput()
Z = ClusterInput()
A = ClusterInput()
G = ClusterInput()
addition = Addition(A=B, B=D)
pln = Plane(G)
vec = VectorXYZ(XComponent="0", YComponent="0", ZComponent=addition)  # -> Vector, Length
move = Move(Geometry=G, Motion=vec.Vector)  # -> Geometry, Transform
S = ClusterInput()
C = ClusterInput()
deplane = DeconstructPlane(Plane=pln)  # -> Origin, XAxis, YAxis, ZAxis
map_srf = MapToSurface(Curve=C, Source=S, Target=move.Geometry)
addition_2 = Addition(A=B, B=B_2)
pdecon = Deconstruct(Point=deplane.Origin)  # -> XComponent, YComponent, ZComponent
xy = XYPlane(Origin=Point(0, 0, 0))
offset = Offset(Curve=map_srf, Distance=addition_2, Plane=S, Corners=1)
addition_3 = Addition(A=D, B=B)
deplane_2 = DeconstructPlane(Plane=xy)  # -> Origin, XAxis, YAxis, ZAxis
pt = ConstructPoint(XCoordinate=0, YCoordinate=0, ZCoordinate=Z)
offset_2 = Offset(Curve=offset, Distance=addition_3, Plane=S, Corners=1)
offset_3 = Offset(Curve=offset, Distance=D, Plane=S, Corners=1)
multiplication = Multiplication(A=pdecon.XComponent, B="0.8")
multiplication_2 = Multiplication(A=pdecon.YComponent, B="0.8")
loft_edges = LoftEdges(C=offset_2)
loft_edges_2 = LoftEdges(C=offset_3)
pl = ConstructPlane(Origin=pt, XAxis=deplane_2.XAxis, YAxis=deplane_2.YAxis)
pt_2 = ConstructPoint(XCoordinate=multiplication, YCoordinate=multiplication_2, ZCoordinate=pdecon.ZComponent)
loft = Loft(Curves=loft_edges, Options={Adjust=False, Closed=True, LoftEnds=0, LoftSimp=0, LoftType=3, Rebuild=10, Refit=0.01})
loft_2 = Loft(Curves=loft_edges_2, Options={Adjust=False, Closed=True, LoftEnds=0, LoftSimp=0, LoftType=3, Rebuild=10, Refit=0.01})
number_slider = Slider(400, range=0..1000)
cp = PlaneClosestPoint(Point=pt_2, Plane=pln)  # -> Point, UVPoint, Distance
cap = CapHoles(Brep=loft)
cap_2 = CapHoles(Brep=loft_2)
planesrf = PlaneSurface(Plane=pl, XSize=number_slider, YSize=number_slider)
pl_2 = ConstructPlane(Origin=cp.Point, XAxis=deplane.XAxis, YAxis=deplane.YAxis)
sdiff = SolidDifference(BrepsA=cap, BrepsB=cap_2)
division = Division(A=A, B="2")
split = SplitBrep(Brep=sdiff, Cutter=planesrf)
neg = Negative(Value=division)
offset_4 = Offset(Surface=pl_2, Distance=neg, Retrim=True)
offset_5 = Offset(Surface=pl_2, Distance=division, Retrim=True)
item = ListItem(List=split, Index="1", Wrap=True)
planesrf_2 = PlaneSurface(Plane=offset_4, XSize="400", YSize="400")
planesrf_3 = PlaneSurface(Plane=offset_5, XSize="400", YSize="400")
cap_3 = CapHoles(Brep=item)
item_2 = ListItem(List=planesrf_2, Index="1", Wrap=True)
item_3 = ListItem(List=planesrf_3, Index="1", Wrap=True)
item_4 = ListItem(List=planesrf_2, Index="3", Wrap=True)
item_5 = ListItem(List=planesrf_3, Index="3", Wrap=True)
split_2 = SplitBrep(Brep=cap_3, Cutter=item_2)
item_6 = ListItem(List=split_2, Index="0", Wrap=True)
split_3 = SplitBrep(Brep=item_6, Cutter=item_3)
item_7 = ListItem(List=split_3, Index="1", Wrap=True)
item_8 = ListItem(List=split_3, Index="0", Wrap=True)
split_4 = SplitBrep(Brep=item_8, Cutter=item_4)
item_9 = ListItem(List=split_4, Index="0", Wrap=True)
split_5 = SplitBrep(Brep=item_9, Cutter=item_5)
item_10 = ListItem(List=split_5, Index="1", Wrap=True)
cap_4 = CapHoles(Brep=[item_7, item_10])
B_3 = ClusterOutput(cap_4)

# ==== cluster Cluster
B = ClusterInput()
A = ClusterInput()
B_2 = ClusterInput()
B_3 = ClusterInput()
A_2 = ClusterInput()
B_4 = ClusterInput()
l0 = ClusterInput()
x = ClusterInput()
x_2 = ClusterInput()
C = ClusterInput()
S = ClusterInput()
T = ClusterInput()
map_srf = MapToSurface(Curve=C, Source=S, Target=T)
addition = Addition(A=A, B=B)
neg = Negative(Value=addition)
offset = Offset(Curve=map_srf, Distance=addition, Plane=PlaneXY(0, 0, 0), Corners=1)
offset_2 = Offset(Curve=map_srf, Distance=neg, Plane=PlaneXY(0, 0, 0), Corners=1)
len = Length(Curve=offset)
len_2 = Length(Curve=offset_2)
larger = LargerThan(FirstNumber=len, SecondNumber=len_2)  # -> LargerThan, OrEqualTo
smaller = SmallerThan(FirstNumber=len, SecondNumber=len_2)  # -> SmallerThan, OrEqualTo
cull = CullPattern(List=offset, CullPattern=larger.LargerThan)
cull_2 = CullPattern(List=offset_2, CullPattern=smaller.SmallerThan)
merge = Merge(Data1=cull, Data2=cull_2)
explode = Explode(Curve=merge, Recursive=True)  # -> Segments, Vertices
pdecon = Deconstruct(Point=explode.Vertices)  # -> XComponent, YComponent, ZComponent
bnd = Bounds(Numbers=pdecon.ZComponent)
dedomain = DeconstructDomain(Domain=bnd)  # -> Start, End
addition_2 = Addition(A=dedomain.Start, B="0.5")
smaller_2 = SmallerThan(FirstNumber=pdecon.ZComponent, SecondNumber=addition_2)  # -> SmallerThan, OrEqualTo
cull_3 = CullPattern(List=explode.Vertices, CullPattern=smaller_2.OrEqualTo)
bnd_2 = Bounds2D(Coordinates=cull_3)
multiplication = Multiplication(A=B, B="2")
dedom2num = DeconstructDomain²(Domain=bnd_2)  # -> UMin, UMax, VMin, VMax
addition_3 = Addition(A=multiplication, B=B_3)
pt = ConstructPoint(XCoordinate=dedom2num.UMin, YCoordinate=dedom2num.VMin, ZCoordinate=dedomain.Start)
pt_2 = ConstructPoint(XCoordinate=dedom2num.UMax, YCoordinate=dedom2num.VMax, ZCoordinate=dedomain.Start)
addition_4 = Addition(A=addition_3, B=B_2)
ln = Line(StartPoint=pt, EndPoint=pt_2)
addition_5 = Addition(A=A_2, B=addition_4)
ext = ExtendCurve(Curve=ln, Type=0, Start=addition_5, End=addition_5)
ext_2 = ExtendCurve(Curve=ln, Type=0, Start=addition_4, End=addition_4)
flatten = FlattenTree(Tree=ln, Path="{0}")
flatten_2 = FlattenTree(Tree=merge, Path="{0}")
end = EndPoints(Curve=ext)  # -> Start, End
end_2 = EndPoints(Curve=ext_2)  # -> Start, End
lng = ListLength(List=flatten)
lng_2 = ListLength(List=flatten_2)
subtraction = Subtraction(A=lng, B="1")
pdecon_2 = Deconstruct(Point=end.Start)  # -> XComponent, YComponent, ZComponent
pdecon_3 = Deconstruct(Point=end.End)  # -> XComponent, YComponent, ZComponent
subtraction_2 = Subtraction(A=lng_2, B="1")
item = ListItem(List=flatten, Index=subtraction, Wrap=True)
addition_6 = Addition(A=pdecon_2.ZComponent, B=B_4)
addition_7 = Addition(A=pdecon_3.ZComponent, B=B_4)
item_2 = ListItem(List=flatten_2, Index=subtraction_2, Wrap=True)
neg_2 = Negative(Value=x)
pt_3 = ConstructPoint(XCoordinate=pdecon_2.XComponent, YCoordinate=pdecon_2.YComponent, ZCoordinate=addition_6)
pt_4 = ConstructPoint(XCoordinate=pdecon_3.XComponent, YCoordinate=pdecon_3.YComponent, ZCoordinate=addition_7)
ext_3 = ExtendCurve(Curve=item, Type=0, Start=l0, End=l0)
ext_4 = ExtendCurve(Curve=item, Type=0, Start=neg_2, End=neg_2)
end_3 = EndPoints(Curve=ext_3)  # -> Start, End
end_4 = EndPoints(Curve=ext_4)  # -> Start, End
rec_2pt = Rectangle2Pt(Plane=merge, PointA=pt_3, PointB=end_2.Start, Radius=0)  # -> Rectangle, Length
rec_2pt_2 = Rectangle2Pt(Plane=merge, PointA=pt_4, PointB=end_2.End, Radius=0)  # -> Rectangle, Length
pdecon_4 = Deconstruct(Point=end_3.End)  # -> XComponent, YComponent, ZComponent
pdecon_5 = Deconstruct(Point=end_3.Start)  # -> XComponent, YComponent, ZComponent
flatten_3 = FlattenTree(Tree=rec_2pt.Rectangle, Path="{0}")
flatten_4 = FlattenTree(Tree=rec_2pt_2.Rectangle, Path="{0}")
addition_8 = Addition(A=pdecon_4.ZComponent, B=B_4)
addition_9 = Addition(A=pdecon_5.ZComponent, B=B_4)
lng_3 = ListLength(List=flatten_3)
pt_5 = ConstructPoint(XCoordinate=pdecon_4.XComponent, YCoordinate=pdecon_4.YComponent, ZCoordinate=addition_8)
pt_6 = ConstructPoint(XCoordinate=pdecon_5.XComponent, YCoordinate=pdecon_5.YComponent, ZCoordinate=addition_9)
subtraction_3 = Subtraction(A=lng_3, B="2")
rec_2pt_3 = Rectangle2Pt(Plane=item_2, PointA=pt_6, PointB=end_4.Start, Radius=0)  # -> Rectangle, Length
rec_2pt_4 = Rectangle2Pt(Plane=item_2, PointA=pt_5, PointB=end_4.End, Radius=0)  # -> Rectangle, Length
dom = ConstructDomain(DomainStart="0", DomainEnd=subtraction_3)
subset = SubList(List=flatten_3, Domain=dom, Wrap=True)  # -> List, Index
subset_2 = SubList(List=flatten_4, Domain=dom, Wrap=True)  # -> List, Index
subtraction_4 = Subtraction(A=lng_3, B="2")
item_3 = ListItem(List=flatten_3, Index=subtraction_4, Wrap=True)
item_4 = ListItem(List=flatten_4, Index=subtraction_4, Wrap=True)
item_5 = ListItem(List=subset.List, Index=lng_3, Wrap=True)
neg_3 = Negative(Value=x_2)
merge_2 = Merge(Data1=item_3, Data2=rec_2pt_3.Rectangle)
merge_3 = Merge(Data1=item_4, Data2=rec_2pt_4.Rectangle)
pl_offset = PlaneOffset(BasePlane=item_5, Offset=neg_3)
loft = Loft(Curves=merge_2, Options={Adjust=False, Closed=False, LoftEnds=0, LoftSimp=0, LoftType=0, Rebuild=10, Refit=0.01})
loft_2 = Loft(Curves=merge_3, Options={Adjust=False, Closed=False, LoftEnds=0, LoftSimp=0, LoftType=0, Rebuild=10, Refit=0.01})
project = Project(Geometry=item_5, Plane=pl_offset)  # -> Geometry, Transform
merge_4 = Merge(Data1=project.Geometry, Data2=subset.List)
merge_5 = Merge(Data1=project.Geometry, Data2=subset_2.List)
loft_3 = Loft(Curves=merge_5, Options={Adjust=False, Closed=False, LoftEnds=0, LoftSimp=0, LoftType=0, Rebuild=10, Refit=0.01})
loft_4 = Loft(Curves=merge_4, Options={Adjust=False, Closed=False, LoftEnds=0, LoftSimp=0, LoftType=0, Rebuild=10, Refit=0.01})
cap = CapHoles(Brep=[loft_4, loft_3, loft, loft_2])
B_5 = ClusterOutput(cap)

# ==== cluster _2DPathToPoint
B = ClusterInput()
D = ClusterInput()
concat = Concatenate(FragmentA="{", FragmentB=B, FragmentC=",", FragmentD=D, FragmentE=",", FragmentF="0", FragmentG="}")
pt = Point(concat)
pt_2 = ClusterOutput(pt)

# ==== cluster LoftEdges
C = ClusterInput()
divide = DivideCurve(Curve=C, Count="1", Kinks="True")  # -> Points, Tangents, Parameters
flatten = FlattenTree(Tree=divide.Points, Path="{0}")
count_points = CountPoints(L=divide.Points)
partition = PartitionList(List=flatten, Size=count_points)
partition_2 = PartitionList(List=partition, Size="1")
split = SplitTree(Data=partition_2, Masks=flatten("{0;0;?}"))  # -> Positive, Negative
split_2 = SplitTree(Data=partition_2, Masks=flatten("{0;1;?}"))  # -> Positive, Negative
split_3 = SplitTree(Data=partition_2, Masks=flatten("{0;2;?}"))  # -> Positive, Negative
split_4 = SplitTree(Data=partition_2, Masks=flatten("{0;3;?}"))  # -> Positive, Negative
split_5 = SplitTree(Data=partition_2, Masks=flatten("{0;4;?}"))  # -> Positive, Negative
split_6 = SplitTree(Data=partition_2, Masks=flatten("{0;5;?}"))  # -> Positive, Negative
path_mapper = PathMapper(split_2.Positive, source="{A;B;C}", target="{A;0;C}")
path_mapper_2 = PathMapper(split_3.Positive, source="{A;B;C}", target="{A;0;C}")
path_mapper_3 = PathMapper(split_4.Positive, source="{A;B;C}", target="{A;0;C}")
path_mapper_4 = PathMapper(split_5.Positive, source="{A;B;C}", target="{A;0;C}")
path_mapper_5 = PathMapper(split_6.Positive, source="{A;B;C}", target="{A;0;C}")
merge = Merge(
    Data1=split.Positive,
    Data2=path_mapper,
    Data3=path_mapper_2,
    Data4=path_mapper_3,
    Data5=path_mapper_4,
    Data6=path_mapper_5)
intcrv = Interpolate(Vertices=merge, Degree=3, Periodic=False, KnotStyle=1)  # -> Curve, Length, Domain
flatten_2 = FlattenTree(Tree=intcrv.Curve, Path="{0}")
partition_3 = PartitionList(List=flatten_2, Size=count_points)
C_2 = ClusterOutput(partition_3)

# ==== cluster ExtrudeCutPolygon
B = ClusterInput()
i = ClusterInput()
L = ClusterInput()
L_2 = ClusterInput()
L_3 = ClusterInput()
item = ListItem(List=L, Index=i, Wrap=True)
item_2 = ListItem(List=L_2, Index=i, Wrap=True)
item_3 = ListItem(List=L_3, Index=i, Wrap=True)
pdecon = Deconstruct(Point=item_2)  # -> XComponent, YComponent, ZComponent
pdecon_2 = Deconstruct(Point=item_3)  # -> XComponent, YComponent, ZComponent
addition = Addition(A=pdecon.ZComponent, B=B)
addition_2 = Addition(A=B, B=pdecon_2.ZComponent)
pt = ConstructPoint(XCoordinate=pdecon.XComponent, YCoordinate=pdecon.YComponent, ZCoordinate=addition)
pt_2 = ConstructPoint(XCoordinate=pdecon_2.XComponent, YCoordinate=pdecon_2.YComponent, ZCoordinate=addition_2)
ln = Line(StartPoint=pt, EndPoint=pt_2)
deplane = DeconstructPlane(Plane=item)  # -> Origin, XAxis, YAxis, ZAxis
ext = ExtendCurve(Curve=ln, Type=0, Start="10", End="10")
end = EndPoints(Curve=ext)  # -> Start, End
R = ClusterInput()
S = ClusterInput()
rf = ClusterInput()
A = ClusterInput()
pl = ConstructPlane(Origin=end.Start, XAxis=deplane.XAxis, YAxis=deplane.ZAxis)
polygon = Polygon(Plane=pl, Radius=R, Segments=S, FilletRadius=rf)  # -> Polygon, Length
rotate = Rotate(Geometry=polygon.Polygon, Angle=A, Plane=pl)  # -> Geometry, Transform
extrcrv = ExtrudeAlong(Base=rotate.Geometry, Curve=ext)
cap = CapHoles(Brep=extrcrv)
B_2 = ClusterOutput(cap)

# ==== cluster CountPoints
L = ClusterInput()
lng = ListLength(List=L)
flatten = FlattenTree(Tree=lng, Path="{0}")
item = ListItem(List=flatten, Index=0, Wrap=True)
i = ClusterOutput(item)
